# Grasshopper definition native-reviewed.gh (Grasshopper 1.0.7)
# plug-ins: Karamba3D

# ---- group: test panel
polygon = Polygon(Plane=PlaneXY(0, 0, 0), Radius=3, Segments=6, FilletRadius=0)  # -> Polygon, Length
Z = UnitZ(Factor=Slider(10, range=0..10))
move = Move(Geometry=polygon.Polygon, Motion=Z)  # -> Geometry, Transform
jumlah_anchor = Slider(23, range=10..50)
divide = DivideCurve(Curve=move.Geometry, Count=jumlah_anchor, Kinks=False)  # -> Points, Tangents, Parameters
divide_2 = DivideCurve(Curve=polygon.Polygon, Count=jumlah_anchor, Kinks=False)  # -> Points, Tangents, Parameters
shift = Slider(6, range=0..10)
sequential_winding = GhPythonScript(P=divide.Points, Shift=shift, Lower=divide_2.Points)  # -> out, A, B; inputs P: tree, Shift: tree, Lower: tree
#   port Lower: Optional lower points for alternating upper/lower winding
#   port B: Sequential endpoints; feed the existing Line B input
# ---------- sequential_winding: Python ----------
"""GhPython: P and Shift use Tree Access; Lower uses optional Tree Access.

Outputs A/B are paired starts/ends consumed by the existing native Line.
Indices wrap within each branch until the original point and layer return.
No flattening, resampling, or point movement occurs here.
"""
from Grasshopper import DataTree
from Grasshopper.Kernel import GH_RuntimeMessageLevel

A = DataTree[object]()
B = DataTree[object]()

def value(item):
    if hasattr(item, 'ScriptVariable'):
        return item.ScriptVariable()
    if hasattr(item, 'Value'):
        return item.Value
    return item

def branch(tree, path):
    if tree is None:
        return None
    for candidate in tree.Paths:
        if str(candidate) == str(path):
            return tree.Branch(candidate)
    return None

def shift_for(path):
    exact = branch(Shift, path)
    if exact is not None and len(exact) == 1:
        return int(value(exact[0]))
    # A single shift applies to every point branch, as in the original slider.
    if Shift is not None and Shift.BranchCount == 1:
        values = Shift.Branch(Shift.Paths[0])
        if len(values) == 1:
            return int(value(values[0]))
    # Allow a scalar on an ancestor path, never a value from a sibling branch.
    if Shift is not None:
        matches = []
        for candidate in Shift.Paths:
            indices = list(candidate.Indices)
            if list(path.Indices)[:len(indices)] == indices:
                values = Shift.Branch(candidate)
                if len(values) == 1:
                    matches.append((len(indices), int(value(values[0]))))
        if matches:
            return max(matches)[1]
    return None

if P is not None:
    alternating = Lower is not None and (Lower.BranchCount > 0 or
        ghenv.Component.Params.Input[2].SourceCount > 0)
    for path in P.Paths:
        points = P.Branch(path)
        lower = branch(Lower, path) if alternating else None
        if alternating and lower is None:
            ghenv.Component.AddRuntimeMessage(GH_RuntimeMessageLevel.Warning,
                'No Lower points at branch ' + str(path))
            continue
        shift = shift_for(path)
        if shift is None:
            ghenv.Component.AddRuntimeMessage(GH_RuntimeMessageLevel.Warning,
                'One shift value is required for branch ' + str(path))
            continue
        step = max(0, shift) + 1
        count = min(len(points), len(lower)) if alternating else len(points)
        if count == 0:
            continue
        currentIndex = 0
        currentLayer = 0
        # There are at most count index states, or 2*count index/layer states.
        # Close only when both the index and the layer reach the initial state.
        for segment in xrange(count * (2 if alternating else 1)):
            nextIndex = (currentIndex + step) % count
            nextLayer = 1 - currentLayer if alternating else 0
            if nextIndex == currentIndex and nextLayer == currentLayer:
                break  # A single-list self-loop would create a zero-length Line.
            starts = lower if currentLayer else points
            ends = lower if nextLayer else points
            A.Add(value(starts[currentIndex]), path)
            B.Add(value(ends[nextIndex]), path)
            currentIndex = nextIndex
            currentLayer = nextLayer
            if currentIndex == 0 and currentLayer == 0:
                break
# ---------- end sequential_winding ----------
ln = Line(StartPoint=sequential_winding.A, EndPoint=sequential_winding.B)
segmen_terlihat = Slider(8, range=0..46)
winding_sequence_preview = GhPythonScript(L=ln, N=segmen_terlihat)  # -> out, V, Total; inputs L: tree; disabled
#   port L: Complete winding Line tree
#   port N: Number of consecutive segments to display
#   port V: First N winding segments per branch
#   port Total: Largest segment count of the input branches
# ---------- winding_sequence_preview: Python ----------
"""Cumulative preview after Line, independently on every Grasshopper branch."""
from Grasshopper import DataTree
from Grasshopper.Kernel.Special import GH_NumberSlider
from Grasshopper.Kernel import GH_Document
from System import Decimal

V = DataTree[object]()
Total = max([0] + [len(L.Branch(path)) for path in L.Paths]) if L is not None else 0
visible = max(0, int(N)) if N is not None else 0

# Keep the UI slider usable when the winding cycle length changes upstream.
sources = ghenv.Component.Params.Input[1].Sources
if len(sources) == 1 and isinstance(sources[0], GH_NumberSlider):
    slider = sources[0]
    bound = Decimal(max(1, Total))
    if slider.Slider.Maximum != bound or slider.Slider.Value > bound:
        document = ghenv.Component.OnPingDocument()
        def update_range(doc, control=slider, maximum=bound):
            if control.OnPingDocument() is None:
                return
            control.Slider.Maximum = maximum
            if control.Slider.Value > maximum:
                control.SetSliderValue(maximum)
            control.ExpireSolution(False)
        # Change UI controls between solutions, never while this component solves.
        if document is not None:
            document.ScheduleSolution(5, GH_Document.GH_ScheduleDelegate(update_range))

if L is not None:
    for path in L.Paths:
        lines = L.Branch(path)
        for i in range(min(visible, len(lines))):
            item = lines[i]
            V.Add(item.ScriptVariable() if hasattr(item, 'ScriptVariable') else item, path)
# ---------- end winding_sequence_preview ----------
winding_preview = Line(winding_sequence_preview.V)

# ----
number_slider = Slider(10, range=0..10)
side5 = Slider(5.6, range=0..10)
side5_2 = Slider(4.5, range=0..10)
top5 = Slider(3, range=0..10)
top5_2 = Slider(3, range=0..10)
X = UnitX(Factor=Slider(1.6, range=0..10))
Z_2 = UnitZ(Factor=Slider(2.5, range=0..10))
Z_3 = UnitZ(Factor=Slider(3, range=0..10))
Z_4 = UnitZ(Factor=Slider(2, range=0..10))
X_2 = UnitX(Factor=Slider(2, range=0..10))
neg = Negative(Value=X)
Z_5 = UnitZ(Factor=Slider(1.5, range=0..10))

# ---- group: 11 | CFRP MATERIAL - properties and source
# 11 | LITERATURE CFRP: Ding et al., Applied Sciences 2022,12,8933, Table1; DOI10.3390/app12188933.
# E1/E2=142/9GPa; G12/G31/G32=4.6/4.6/3.08GPa; nu12=.32; rho1620kg/m3.
# Xt/Xc/Yt/Yc/S12=1900/1100/51/130/72MPa. f12=-.5 assumed; SF2.
# This is the same material reference as the prior analysis, not measured Stuttgart material.
# Karamba shell is plane stress, neglecting transverse shear. No gravity or thermal load.
xc_kn_cm2 = Panel("-110")  # disabled
e1_kn_cm2 = Panel("14200")  # disabled
s12_kn_cm2 = Panel("7.2")  # disabled
e2_kn_cm2 = Panel("900")  # disabled
g12_kn_cm2 = Panel("460")  # disabled
nu12 = Panel("0.32")  # disabled
g31_kn_cm2 = Panel("460")  # disabled
g32_kn_cm2 = Panel("308")  # disabled
gamma_kn_m3 = Panel("15.886773")  # disabled
alpha1_1_c_assumed_thermal_inactive = Panel("0")  # disabled
xt_kn_cm2 = Panel("190")  # disabled
yt_kn_cm2 = Panel("5.1")  # disabled
yc_kn_cm2 = Panel("-13")  # disabled
f12_assumed = Panel("-0.5")  # disabled
alpha2_1_c_assumed_thermal_inactive = Panel("0")  # disabled
composite_density_kg_m3 = Panel("1620")
orthotropic = MaterialPropertiesKaramba3D(
    FamilyOfMaterial="CFRP",
    Name="FAW200RC38 T700 epoxy | Ding2022 Table1",
    YoungsModulusKNCm²Dir1=e1_kn_cm2,
    YoungsModulusKNCm²Dir2=e2_kn_cm2,
    InPlaneShearModulus_kN_cm²=g12_kn_cm2,
    InPlaneLateralContractionCoefficient=nu12,
    TransverseShearModulusKNCm²Dir1=g31_kn_cm2,
    TransverseShearModulusKNCm²Dir2=g32_kn_cm2,
    SpecificWeight_kN_m³=gamma_kn_m3,
    CoefficientOfThermalExpansion1Dir1=alpha1_1_c_assumed_thermal_inactive,
    CoefficientOfThermalExpansion1Dir2=alpha2_1_c_assumed_thermal_inactive,
    TensileStrengthKNCm²Dir1=xt_kn_cm2,
    TensileStrengthKNCm²Dir2=yt_kn_cm2,
    CompressiveStrengthKNCm²Dir1=xc_kn_cm2,
    CompressiveStrengthKNCm²Dir2=yc_kn_cm2,
    ShearStrengthKNCm²Dir12=s12_kn_cm2,
    TsaiWuIntCoeff=f12_assumed,
    StrengthHypothesis="TsaiWu",
    mode="Orthotropic")  # disabled

# ---- group: 14 | ORTHOTROPIC COUPON - excluded from pavilion
shell_const = CrossSectionsShellKaramba3D(
    FamilyNameOfCrossSection="CFRP COUPON",
    NameOfCrossSection="COUPON",
    Material=orthotropic,
    Height_cm=0.1,
    mode="Shell - Const")  # -> CrossSection, CentreOfGravity; disabled
ud_coupon_independent_0_90 = GhPythonScript(Refine=0)  # -> Mesh, X, Left, Origin, All, LoadP, LoadV, Report; disabled
# ---------- ud_coupon_independent_0_90: Python ----------
import math,Rhino.Geometry as rg
from Grasshopper import DataTree
from Grasshopper.Kernel.Data import GH_Path
def val(v):return v.Value if hasattr(v,'Value') else v
n=int(val(Refine));nx=4*2**n;ny=2*2**n
Mesh=DataTree[object]();X=DataTree[object]();Left=DataTree[object]();Origin=DataTree[object]();All=DataTree[object]();LoadP=DataTree[object]();LoadV=DataTree[object]()
for case in range(2):
 path=GH_Path(case);mesh=rg.Mesh()
 for j in range(ny+1):
  for i in range(nx+1):mesh.Vertices.Add(i/float(nx),.1*j/ny,0)
 for j in range(ny):
  for i in range(nx):
   a=j*(nx+1)+i;b=a+1;c=a+nx+2;d=a+nx+1
   mesh.Faces.AddFace(a,b,c);mesh.Faces.AddFace(a,c,d)
 mesh.Normals.ComputeNormals();Mesh.Add(mesh,path);X.Add(rg.Vector3d(1,0,0) if case==0 else rg.Vector3d(0,1,0),path)
 for v in mesh.Vertices:All.Add(rg.Point3d(v),path)
 for j in range(ny+1):
  Left.Add(rg.Point3d(0,.1*j/ny,0),path);LoadP.Add(rg.Point3d(1,.1*j/ny,0),path)
  LoadV.Add(rg.Vector3d((.5 if j in [0,ny] else 1.0)/ny,0,0),path)
 Origin.Add(rg.Point3d(0,0,0),path)
Report='NATIVE UD COUPON: 1m x 0.1m x 1mm; +X 1kN uniform edge traction; free transverse contraction.\n{0}: local fibre X, {1}: local fibre Y. Isolated models, not combined.\nTx fixed at left, Ty at origin, Tz all nodes (planar membrane coupon only).\nRefinement %s: %s triangles per coupon.'%(n,mesh.Faces.Count)
# ---------- end ud_coupon_independent_0_90 ----------
mesh_to_shell = MeshToShellKaramba3D(
    Mesh=ud_coupon_independent_0_90.Mesh,
    Identifier="COUPON",
    CrossSection=shell_const.CrossSection,
    LimitDistance_m=1e-07,
    Bending=False,
    GuidGeneratorSeed=-18296673)  # -> Element, Points, Info; disabled
supp = SupportKaramba3D(
    PosInd=ud_coupon_independent_0_90.Left,
    Ct_kN_m=Vector(0, 0, 0),
    Cr_kNm_rad=Vector(0, 0, 0),
    Dofs=0,
    menu=[buttons(off, off, off, off, off, off)])  # disabled
supp_2 = SupportKaramba3D(
    PosInd=ud_coupon_independent_0_90.Origin,
    Ct_kN_m=Vector(0, 0, 0),
    Cr_kNm_rad=Vector(0, 0, 0),
    Dofs=1,
    menu=[buttons(off, off, off, off, off, off)])  # disabled
supp_3 = SupportKaramba3D(
    PosInd=ud_coupon_independent_0_90.All,
    Ct_kN_m=Vector(0, 0, 0),
    Cr_kNm_rad=Vector(0, 0, 0),
    Dofs=2,
    menu=[buttons(off, off, off, off, off, off)])  # disabled
shell = OrientateElemKaramba3D(Shell=mesh_to_shell.Element, XOrientations=ud_coupon_independent_0_90.X, mode="Shell")  # disabled
pointload = LoadsKaramba3D(
    ForceVector=ud_coupon_independent_0_90.LoadV,
    Local=False,
    PosInd=ud_coupon_independent_0_90.LoadP,
    LCase="COUPON_X",
    mode="Point")  # disabled
assemble = AssembleModelKaramba3D(Elem=shell, Support=[supp, supp_2, supp_3], Load=pointload, LimitDistance_m=0.005)  # -> Model, Info, Mass_kg, CentreOfGravity, LoadCaseNames; disabled
analyse = AnalyseKaramba3D(Model=assemble.Model, LoadCases="COUPON_X")  # -> AnalysedModel, MaximumDisplacement_cm, ResultingForce_kN, ChangeOfElasticEnergy_kNm; disabled
react = ReactionForcesKaramba3D(AnalysedModel=analyse.AnalysedModel, LoadCase="COUPON_X")  # -> Model, ReactionForces_kN, ReactionMoments_kNm, SupportPosition, SumOfReactionForces_kN, SumOfReactionMoments_kNm, GoverningLoadCaseIndex; disabled
nodedisp = NodalDisplacementsKaramba3D(AnalysedModel=analyse.AnalysedModel, LoadCaseCombination="COUPON_X")  # -> Model, NodalTranslations_m, NodalRotations_rad, DisplacementPosition, LoadCaseIndex; disabled
coupon_e1_e2_validation = GhPythonScript(
    Models=analyse.AnalysedModel,
    Trans=nodedisp.NodalTranslations_m,
    Pos=nodedisp.DisplacementPosition,
    SumRF=react.SumOfReactionForces_kN,
    Material=orthotropic)  # -> U0mm, U90mm, Ratio, Passed, Result, Report; inputs Models: tree, Trans: tree, Pos: tree, SumRF: tree; disabled
# ---------- coupon_e1_e2_validation: Python ----------
import math,json
def val(v):return v.Value if hasattr(v,'Value') else v
mat=val(Material);models=[val(v) for v in Models.AllData()];means=[];rows=[]
if len(models)!=2:raise ValueError('Coupon requires two separate analysed models.')
for case,model in enumerate(models):
 if not model.displacementsReady():raise ValueError('Coupon model has not been analysed.')
 samples=[]
 for path in Trans.Paths:
  if path.Indices[0]!=case:continue
  tr=[val(v) for v in Trans.Branch(path)];p=model.nodes[path.Indices[-1]].pos
  for u in tr:
   if abs(p.X-1)<1e-7:samples.append(u.X)
 if not samples:raise ValueError('No coupon loaded-edge displacements found; check result tree.')
 u=sum(samples)/len(samples);means.append(u)
 volume=sum(e.Volume(model.nodes) for e in model.Elements());thickness=volume/.1
 expected=1/(float(mat.E(case))*.1*thickness)
 reactions=[val(v) for p in SumRF.Paths if p.Indices[0]==case for v in SumRF.Branch(p)];rf=sum(v.X for v in reactions);residual=abs(rf+1)
 rows.append(dict(orientation_deg=90*case,nodes=len(model.nodes),elements=len(list(model.Elements())),thickness_m=thickness,loaded_edge_ux_m=u,expected_ux_m=expected,relative_error=abs(u/expected-1),reaction_x_kN=rf,equilibrium_residual_kN=residual))
ratio=means[1]/means[0];expectedratio=float(mat.E(0))/float(mat.E(1));Passed=all(r['relative_error']<.005 and r['equilibrium_residual_kN']<1e-7 for r in rows) and abs(ratio/expectedratio-1)<.005
U0mm=means[0]*1000;U90mm=means[1]*1000;Ratio=ratio
Result=json.dumps(dict(test='Native Karamba membrane coupon 0/90 under identical +X traction',passed=Passed,ratio=ratio,expected_ratio=expectedratio,rows=rows),separators=(',',':'))
Report='NATIVE 0/90 ANISOTROPY: %s\nu0 = %.6f mm; u90 = %.6f mm. Ratio %.6f; expected E1/E2 %.6f.\nMaximum relative analytical error %.5g%%. Maximum reaction residual %.5g kN.\nJournal orthotropic E1/E2 and local material axes are active in the solver.'%('PASS' if Passed else 'FAIL',U0mm,U90mm,ratio,expectedratio,max(r['relative_error'] for r in rows)*100,max(r['equilibrium_residual_kN'] for r in rows))
# ---------- end coupon_e1_e2_validation ----------
panel = Panel(coupon_e1_e2_validation.Report)  # disabled

# ----
license = LicenseKaramba3D()
settings = SettingsKaramba3D(menu=[dropdown(0)])  # -> AllSettings, GenericOutput; disabled
orthotropic_2 = MaterialPropertiesKaramba3D(
    FamilyOfMaterial="CFRP",
    Name="FAW200RC38 T700 epoxy | Ding2022 Table1",
    YoungsModulusKNCm²Dir1=14200,
    YoungsModulusKNCm²Dir2=900,
    InPlaneShearModulus_kN_cm²=460,
    InPlaneLateralContractionCoefficient=0.32,
    TransverseShearModulusKNCm²Dir1=460,
    TransverseShearModulusKNCm²Dir2=308,
    SpecificWeight_kN_m³=15.886773,
    CoefficientOfThermalExpansion1Dir1=0,
    CoefficientOfThermalExpansion1Dir2=0,
    TensileStrengthKNCm²Dir1=190,
    TensileStrengthKNCm²Dir2=5.1,
    CompressiveStrengthKNCm²Dir1=-110,
    CompressiveStrengthKNCm²Dir2=-13,
    ShearStrengthKNCm²Dir12=7.2,
    TsaiWuIntCoeff=-0.5,
    StrengthHypothesis="TsaiWu",
    mode="Orthotropic")
orthotropic_3 = MaterialPropertiesKaramba3D(
    FamilyOfMaterial="Aluminium",
    Name="EN AW-6060 conceptual local sleeve",
    YoungsModulusKNCm²Dir1=6900,
    YoungsModulusKNCm²Dir2=6900,
    InPlaneShearModulus_kN_cm²=2600,
    InPlaneLateralContractionCoefficient=0.3269230769,
    TransverseShearModulusKNCm²Dir1=2600,
    TransverseShearModulusKNCm²Dir2=2600,
    SpecificWeight_kN_m³=26.477955,
    CoefficientOfThermalExpansion1Dir1=0,
    CoefficientOfThermalExpansion1Dir2=0,
    TensileStrengthKNCm²Dir1=15,
    TensileStrengthKNCm²Dir2=15,
    CompressiveStrengthKNCm²Dir1=-15,
    CompressiveStrengthKNCm²Dir2=-15,
    ShearStrengthKNCm²Dir12=8,
    TsaiWuIntCoeff=-0.5,
    StrengthHypothesis="TsaiWu",
    mode="Orthotropic")
o_section = CrossSectionsBeamKaramba3D(
    FamilyNameOfCrossSection="CFRP EQUIVALENT REINFORCED EDGE",
    NameOfCrossSection="NG_EDGE",
    Material=orthotropic_2,
    Diameter_cm=1,
    WallThickness_cm=0.5,
    mode="Circular Hollow")  # -> CrossSection, CentreOfGravity
o_section_2 = CrossSectionsBeamKaramba3D(
    FamilyNameOfCrossSection="LOCAL AL SLEEVE EQUIVALENT",
    NameOfCrossSection="NG_LINK",
    Material=orthotropic_3,
    Diameter_cm=1.2,
    WallThickness_cm=0.27,
    mode="Circular Hollow")  # -> CrossSection, CentreOfGravity
gravity = GravityKaramba3D(Vector=Vector(0, 0, -1), LCase="G")
gravity_2 = GravityKaramba3D(Vector=Vector(0, 0, -1), LCase="G_X_POS")
gravity_3 = GravityKaramba3D(Vector=Vector(0, 0, -1), LCase="G_X_NEG")
gravity_4 = GravityKaramba3D(Vector=Vector(0, 0, -1), LCase="G_Y_POS")
gravity_5 = GravityKaramba3D(Vector=Vector(0, 0, -1), LCase="G_Y_NEG")
ng01_frozen_native_c_frame_points = Point([Point(8.696294837, 1.53806597, 1.117442051), Point(8, 1.25, 0), Point(7.573714446, 1.042602836, 0), Point(7.744068136, 1.210757051, 0.6700994926), Point(8.909544727, 0.5695183785, 1.286033742), Point(8.493469226, 0.3917284925, 0)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])
ng01_below_ground_existing_native_anchor = Point([Point(8.136846376, 0.8781461934, -0.04545751345), Point(7.986447095, 0.8072329962, -0.01835429376), Point(-0.01564938521, 0.8279621283, -0.007451860481), Point(-0.1577637457, 0.8849406336, -0.02573820167), Point(3.513052875, 7.016187741, -0.03367225331), Point(3.738482875, 6.978887595, -0.02155111887), Point(3.963912875, 6.941587449, -0.009429984422)])  # "NG01 BELOW GROUND | existing native anchor positions"
# 21 | REFERENCE MODEL LIMITS
# Existing 72 panels and sequential winding preserved. No new winding pass or reinforcement.
# Crossing strands remain unbonded; endpoint/frame joints are idealized point bonds.
# Four fixed ground corners, 10mm boundary and20mm x0.981747704mm ribbons are ASSUMED.
# Current reference load +X1kN; gravity inactive. No real wind design load supplied.
# Raw point-attachment stress peaks are retained. Convergence has NOT been established on this new geometry.
# Mass counts modeled CFRP only; joints/foundations excluded. Openness is projected area, not porosity or ventilation.
# Construction safety UNVERIFIED. Source geometry can be changed upstream; run validation after changes.
# WORKFLOW | NEW SEQUENCE CFRP FE
# 1 Existing A/B boundaries and original sequence lines -> per-panel ribbon mesh; no new winding.
# 2 CFRP MatProps + shell section -> MeshToShell -> local X along each actual strand.
# 3 Unique boundary beams + four assumed supports + total +X1kN -> native seed assembly.
# 4 Explicit node adapter restores exact ribbon geometry and private strand IDs before analysis. Native seed coordinate bonds are discarded.
# 5 Native Analyze -> shell N/M + beam N/V/T/M -> raw top/bottom MPa, max stress, Tsai-Wu and critical vectors.
# 6 Force/moment/work/volume/ownership/coupon checks -> BASIC PASS; mesh convergence UNTESTED.
# 7 Original route length + native unique beams + rho -> mass and weight; finite-section projected openness in three views.
# DATA: mesh {panel;family}; raw stress {panel;family;strand;face;side}; family0 original, no reinforcement.
# Native mass comes from the final owned model. Reaction coordinates come from Support Position, not load-case index.
# Convergence and construction safety require separate verification.
ng01_red_anchors_below_z0 = CustomPreview(
    Geometry=ng01_below_ground_existing_native_anchor,
    Material=[{diffuse=RGB(221, 160, 221), emission=RGB(66, 48, 66), shine=0.5, specular=RGB(255, 255, 255), transparency=0}, {diffuse=RGB(205, 64, 45), emission=RGB(0, 0, 0), shine=0, specular=RGB(255, 255, 255), transparency=0}])
license_2 = LicenseKaramba3D()  # disabled

# ---- group: Pavilion
pavilion_length = Slider(8, range=0..10)
pavilion_width = Slider(7, range=0..10)
xy = XYPlane(Origin=Point(0, 0, 0))
rectangle = Rectangle(Plane=xy, XSize=pavilion_length, YSize=pavilion_width, Radius=0)  # -> Rectangle, Length
area = Area(Geometry=rectangle.Rectangle)  # -> Area, Centroid
division = Division(A=pavilion_length, B="2")
X_3 = UnitX(Factor=1)
amp = Amplitude(Vector=X_3, Amplitude=division)
neg_2 = Negative(Value=amp)
move_2 = Move(Geometry=area.Centroid, Motion=neg_2)  # -> Geometry, Transform
move_3 = Move(Geometry=area.Centroid, Motion=amp)  # -> Geometry, Transform
ln_2 = Line(StartPoint=move_3.Geometry, EndPoint=move_2.Geometry)
section_divisions = Panel("6")
divide_3 = DivideCurve(Curve=ln_2, Count=section_divisions, Kinks=False)  # -> Points, Tangents, Parameters
pframe = PerpFrame(Curve=ln_2, Parameter=divide_3.Parameters)
deplane = DeconstructPlane(Plane=pframe)  # -> Origin, XAxis, YAxis, ZAxis
side4 = Slider(7.2, range=0..10)
side5_3 = Slider(6.5, range=0..10)
side2 = Slider(5.6, range=0..10)
side3 = Slider(6.5, range=0..10)
side1 = Slider(4.5, range=0..10)
top1 = Slider(4, range=0..10)
top2 = Slider(3.8, range=0..10)
top4 = Slider(3.6, range=0..10)
merge = Merge(Data1=side1, Data2=side2, Data3=side3, Data4=side4, Data5=side5_3, Data6=side5, Data7=side5_2)
merge_2 = Merge(
    Data1=top1,
    Data2=top2,
    Data3=Slider(3.7, range=0..10),
    Data4=top4,
    Data5=Slider(3.4, range=0..10),
    Data6=top5,
    Data7=top5_2)
Z_6 = UnitZ(Factor=1)
Y = UnitY(Factor=1)
division_2 = Division(A=merge, B="2")
amp_2 = Amplitude(Vector=Z_6, Amplitude=merge_2)
amp_3 = Amplitude(Vector=Y, Amplitude=division_2)
move_kanan = Move(Geometry=deplane.Origin, Motion=amp_3)  # -> Geometry, Transform
neg_3 = Negative(Value=amp_3)
move_tengah = Move(Geometry=deplane.Origin, Motion=amp_2)  # -> flatten(Geometry), Transform
move_kiri = Move(Geometry=deplane.Origin, Motion=neg_3)  # -> Geometry, Transform

# ----
item = ListItem(List=move_kanan.Geometry, Index="0", Wrap=True)
item_2 = ListItem(List=move_kanan.Geometry, Index="1", Wrap=True)
item_3 = ListItem(List=move_kanan.Geometry, Index="2", Wrap=True)
item_4 = ListItem(List=move_kanan.Geometry, Index="3", Wrap=True)
item_5 = ListItem(List=move_kanan.Geometry, Index="6", Wrap=True)
item_6 = ListItem(List=move_kanan.Geometry, Index="4", Wrap=True)
item_7 = ListItem(List=move_kanan.Geometry, Index="5", Wrap=True)
item_8 = ListItem(List=move_tengah.Geometry, Index="0", Wrap=True)
item_9 = ListItem(List=move_tengah.Geometry, Index="1", Wrap=True)
item_10 = ListItem(List=move_tengah.Geometry, Index="6", Wrap=True)
item_11 = ListItem(List=move_tengah.Geometry, Index="2", Wrap=True)
item_12 = ListItem(List=move_tengah.Geometry, Index="3", Wrap=True)
item_13 = ListItem(List=move_tengah.Geometry, Index="4", Wrap=True)
item_14 = ListItem(List=move_tengah.Geometry, Index="5", Wrap=True)
move_4 = Move(Geometry=item, Motion=Z_2)  # -> Geometry, Transform
move_5 = Move(Geometry=item_5, Motion=Z_3)  # -> Geometry, Transform
move_6 = Move(Geometry=item_7, Motion=Z_4)  # -> Geometry, Transform
move_7 = Move(Geometry=item_8, Motion=X_2)  # -> Geometry, Transform
move_8 = Move(Geometry=item_10, Motion=neg)  # -> Geometry, Transform
move_9 = Move(Geometry=item_2, Motion=Z_5)  # -> Geometry, Transform
merge_3 = Merge(Data1=move_7.Geometry, Data2=item_9, Data3=item_11, Data4=item_12, Data5=item_13, Data6=item_14, Data7=move_8.Geometry)
merge_4 = Merge(
    Data1=move_4.Geometry,
    Data2=move_9.Geometry,
    Data3=item_3,
    Data4=item_4,
    Data5=item_6,
    Data6=move_6.Geometry,
    Data7=move_5.Geometry)

# ---- group: Pavilion (continued)
entwine = Entwine(Branch00=move_kiri.Geometry, Branch01=merge_3, Branch02=merge_4, FlattenInputs=True)
flip = FlipMatrix(Data=entwine)
intcrv = Interpolate(Vertices=flip, Degree=3, Periodic=False, KnotStyle=1)  # -> Curve, Length, Domain

# ---- group: Project hexagon
xy_2 = XYPlane(Origin=Point(0, 0, 0))
dom = ConstructDomain(DomainStart="0", DomainEnd="1")
rectangle_2 = Rectangle(Plane=xy_2, XSize=dom, YSize=dom, Radius=0)  # -> Rectangle, Length
flatten = FlattenTree(Tree=intcrv.Curve, Path="{0}")

# ---- group: 00 | JUMLAH PANEL | slider 1-144
jumlah_panel = Slider(87, range=36..100)
panel_count_full_surface_honeycomb = GhPythonScript(N=jumlah_panel, Domain=rectangle_2.Rectangle)  # -> out, Cells, Count
#   port N: Complete winding Line tree
#   port Domain: Number of consecutive segments to display
#   port Cells: First N winding segments per branch
#   port Count: Largest segment count of the input branches
# ---------- panel_count_full_surface_honeycomb: Python ----------
"""Exact-count, staggered honeycomb-like Voronoi cells covering the full UV square.

Pure geometry helpers shared verbatim with the embedded GhPython controller.
Boundary cells are clipped polygons; their number of sides need not be six.
"""
import math

def area(poly):
    return abs(sum(a[0]*b[1]-a[1]*b[0] for a,b in zip(poly,poly[1:]+poly[:1])))*0.5

def clip(poly,nx,ny,c):
    if not poly:return []
    out=[];a=poly[-1];da=nx*a[0]+ny*a[1]-c
    for b in poly:
        db=nx*b[0]+ny*b[1]-c
        if (da<=0)!=(db<=0):
            t=da/(da-db);out.append((a[0]+t*(b[0]-a[0]),a[1]+t*(b[1]-a[1])))
        if db<=0:out.append(b)
        a=b;da=db
    clean=[]
    for p in out:
        if not clean or math.hypot(p[0]-clean[-1][0],p[1]-clean[-1][1])>1e-12:clean.append(p)
    if len(clean)>1 and math.hypot(clean[0][0]-clean[-1][0],clean[0][1]-clean[-1][1])<=1e-12:clean.pop()
    return clean

def layout(n):
    n=int(n)
    if n<1 or n>144:raise ValueError('Jumlah Panel must be an integer from 1 to 144.')
    rows=max(1,min(n,int(round(math.sqrt(n/math.sqrt(0.75))))))
    base,extra=divmod(n,rows);seeds=[]
    for row in range(rows):
        columns=base+(1 if row<extra else 0)
        for col in range(columns):
            seeds.append(((col+0.5+0.5*(row%2))/(columns+0.5),(row+0.5)/float(rows)))
    cells=[]
    for i,(x,y) in enumerate(seeds):
        poly=[(0.,0.),(1.,0.),(1.,1.),(0.,1.)]
        for j,(u,v) in enumerate(seeds):
            if i!=j:poly=clip(poly,u-x,v-y,(u*u+v*v-x*x-y*y)*0.5)
        if len(poly)<3 or area(poly)<=1e-12:raise ValueError('Degenerate panel cell.')
        cells.append(poly)
    if len(cells)!=n or abs(sum(area(p) for p in cells)-1.)>1e-10:raise ValueError('Panel coverage check failed.')
    return seeds,cells

import Rhino.Geometry as rg
from Grasshopper import DataTree
from Grasshopper.Kernel.Data import GH_Path
def unwrap(v):
    return v.ScriptVariable() if hasattr(v,'ScriptVariable') else v
n=int(unwrap(N));boundary=unwrap(list(ghenv.Component.Params.Input[1].VolatileData.AllData(True))[0]);box=boundary.BoundingBox if hasattr(boundary,'BoundingBox') else boundary.GetBoundingBox(True)
seeds,polys=layout(n);Cells=DataTree[object]()
for i,poly in enumerate(polys):
    pts=[rg.Point3d(box.Min.X+x*(box.Max.X-box.Min.X),box.Min.Y+y*(box.Max.Y-box.Min.Y),0) for x,y in poly]
    pts.append(pts[0]);Cells.Add(rg.PolylineCurve(pts),GH_Path(i))
Count=len(polys)
print('Jumlah Panel: %d | complete source UV domain | winding source unchanged | FE PAUSED'%Count)
# ---------- end panel_count_full_surface_honeycomb ----------
jumlah_panel_aktual = Panel(panel_count_full_surface_honeycomb.Count)

# ----
loft = Loft(Curves=flatten, Options={Adjust=False, Closed=False, LoftEnds=0, LoftSimp=0, LoftType=0, Rebuild=50, Refit=0.01})

# ---- group: Project hexagon (continued)
explode = Explode(Curve=panel_count_full_surface_honeycomb.Cells, Recursive=True)  # -> Segments, Vertices
evalsrf = EvaluateSurface(Surface=reparameterize(loft), Point=explode.Vertices)  # -> Point, Normal, UDirection, VDirection, Frame
clean = CleanTree(RemoveNulls=True, RemoveInvalid=True, RemoveEmpty=True, Tree=evalsrf.Point)
pline = PolyLine(Vertices=clean, Closed=False)  # -> flatten(Polyline)
cullpt = CullDuplicates(Points=clean, Tolerance=0.1, CullMode=3)  # -> Points, Indices, Valence
del = DelaunayMesh(Points=cullpt.Points, Plane=PlaneXY(0, 0, 0))

# ---- group: winding
jarak_boundary = Slider(1, range=0.1..1)
neg_4 = Negative(Value=jarak_boundary)
offset = OffsetSurface(Surface=loft, Distance=neg_4, Retrim=True)
evalsrf_2 = EvaluateSurface(Surface=reparameterize(offset), Point=explode.Vertices)  # -> Point, Normal, UDirection, VDirection, Frame
clean_2 = CleanTree(RemoveNulls=True, RemoveInvalid=True, RemoveEmpty=True, Tree=evalsrf_2.Point)
pline_2 = PolyLine(Vertices=clean_2, Closed=False)  # -> flatten(Polyline)
jumlah_anchor_2 = Slider(13, range=10..50)
shift_2 = Slider(6, range=5..6)

# ----
ng02_boundary_alas_datar_z_0_native_c = CSharpScript(OriginalA=pline, OriginalB=pline_2)  # -> out, CorrectedA, CorrectedB, GroundEdges, Meta, Report, GroundHighlight; inputs OriginalA: tree, OriginalB: tree; disabled
# ---------- ng02_boundary_alas_datar_z_0_native_c: C# usings ----------
using System;
using System.Linq;
using System.Collections.Generic;
using Rhino.Geometry;
using Grasshopper;
# ---------- ng02_boundary_alas_datar_z_0_native_c: C# ----------
var r=GroundClip();
CorrectedA=r.A;
CorrectedB=r.B;
GroundEdges=r.Ground;
Meta=r.Meta;
Report=r.Report;
GroundHighlight=r.Highlight;
# ---------- ng02_boundary_alas_datar_z_0_native_c: C# additional code ----------
// Native RhinoCommon polygon clipping. The loft and upper polygon vertices are preserved.
class GroundResult {
 public Grasshopper.DataTree<Curve> A=new Grasshopper.DataTree<Curve>(),B=new Grasshopper.DataTree<Curve>(),Ground=new Grasshopper.DataTree<Curve>();
 public Grasshopper.DataTree<Mesh> Highlight=new Grasshopper.DataTree<Mesh>();public string Meta,Report;
}
string Gnum(double x){return x.ToString("R",System.Globalization.CultureInfo.InvariantCulture);}
GroundResult GroundClip(){
 var r=new GroundResult();var changed=new List<string>();double before=Double.PositiveInfinity,after=Double.PositiveInfinity,total=0;int count=0;
 for(int layer=0;layer<2;layer++){
  var t=Component.Params.Input[layer].VolatileData;int owner=0;
  for(int b=0;b<t.PathCount;b++)foreach(Grasshopper.Kernel.Types.IGH_Goo goo in t.get_Branch(b)){
   var c=((Grasshopper.Kernel.Types.GH_Curve)goo).Value;Polyline pl;if(!c.TryGetPolyline(out pl)||!pl.IsClosed)throw new Exception("Closed native polygon required");
   var input=pl.Take(pl.Count-1).ToList();foreach(var q in input)before=Math.Min(before,q.Z);
   bool edit=input.Any(q=>q.Z<0);Curve result=c.DuplicateCurve();
   if(edit){
    var output=new List<Point3d>();Point3d prev=input[input.Count-1];bool prevIn=prev.Z>=0;
    foreach(var cur in input){bool curIn=cur.Z>=0;if(curIn!=prevIn){double u=-prev.Z/(cur.Z-prev.Z);var q=prev+(cur-prev)*u;q.Z=0;output.Add(q);}if(curIn)output.Add(cur);prev=cur;prevIn=curIn;}
    var unique=new List<Point3d>();foreach(var q in output)if(unique.Count==0||q.DistanceTo(unique[unique.Count-1])>1e-10)unique.Add(q);
    if(unique.Count>1&&unique[0].DistanceTo(unique[unique.Count-1])<1e-10)unique.RemoveAt(unique.Count-1);
    if(unique.Count<3)throw new Exception("Clipping removes entire panel");unique.Add(unique[0]);result=new PolylineCurve(unique);
    changed.Add("\"P"+(owner+1).ToString("000")+" "+(layer==0?"A":"B")+"\"");
   }
   Polyline post;result.TryGetPolyline(out post);foreach(var q in post)after=Math.Min(after,q.Z);
   for(int j=0;j<post.Count-1;j++)if(Math.Abs(post[j].Z)<1e-10&&Math.Abs(post[j+1].Z)<1e-10&&post[j].DistanceTo(post[j+1])>1e-10){var l=new LineCurve(post[j],post[j+1]);r.Ground.Add(l,new Grasshopper.Kernel.Data.GH_Path(owner,layer));var plane=new Plane(post[j],post[j+1]-post[j]);var cylinder=new Cylinder(new Circle(plane,.012),l.GetLength());r.Highlight.Add(Mesh.CreateFromCylinder(cylinder,1,12),new Grasshopper.Kernel.Data.GH_Path(owner,layer));count++;total+=l.GetLength();}
   (layer==0?r.A:r.B).Add(result,t.Paths[b]);owner++;
  }
 }
 r.Meta="{\"method\":\"native RhinoCommon polygon clipping at Z=0\",\"boundary_zmin_before_m\":"+Gnum(before)+",\"boundary_zmin_after_m\":"+Gnum(after)+",\"changed_polygons\":["+String.Join(",",changed)+"],\"ground_edges\":"+count+",\"ground_length_owner_sum_m\":"+Gnum(total)+"}";
 r.Report="GROUND BOUNDARY Z=0 / NATIVE C#\n"+changed.Count+" polygons clipped; loft unchanged.\nMinimum boundary Z: "+Gnum(before)+" -> "+Gnum(after)+" m.\n"+count+" complete flat ground edges.\nAnchors and winding recomputed on corrected polygons.\nGeometry preview; no structural result is represented by these colors.";
 return r;
}
# ---------- end ng02_boundary_alas_datar_z_0_native_c ----------
ng03_local_support_slopes_retained = CSharpScript(OriginalA=pline, OriginalB=pline_2, NativeUVCells=panel_count_full_surface_honeycomb.Cells)  # -> out, A, B, GroundEdges, Highlight, Meta, Report, SlopeHighlight, OpenProfile; inputs OriginalA: tree, OriginalB: tree, NativeUVCells: tree
# ---------- ng03_local_support_slopes_retained: C# ----------
var r=LocalBase();
A=r.A;
B=r.B;
GroundEdges=r.Ground;
Highlight=r.Highlight;
Meta=r.Meta;
Report=r.Report;
SlopeHighlight=r.SlopeHighlight;
OpenProfile=r.OpenProfile;
# ---------- ng03_local_support_slopes_retained: C# additional code ----------
// Keep the open-side slopes. Only its lowest complete panel edge becomes a flat foot.
class LocalBaseResult {
 public Grasshopper.DataTree<Curve> A=new Grasshopper.DataTree<Curve>(),B=new Grasshopper.DataTree<Curve>(),Ground=new Grasshopper.DataTree<Curve>(),OpenProfile=new Grasshopper.DataTree<Curve>();
 public Grasshopper.DataTree<Mesh> Highlight=new Grasshopper.DataTree<Mesh>(),SlopeHighlight=new Grasshopper.DataTree<Mesh>();
 public string Meta,Report;
}
class LocalBaseEdge {public int Panel,Edge;public double Lo,Hi,Mean,MidDistance;}
List<Curve> LBcurves(int i){return Component.Params.Input[i].VolatileData.AllData(true).Select(g=>(Curve)g.ScriptVariable()).ToList();}
string LBn(double x){return x.ToString("R",System.Globalization.CultureInfo.InvariantCulture);}
string LBxyz(Point3d p){return "["+LBn(p.X)+","+LBn(p.Y)+","+LBn(p.Z)+"]";}
Mesh LBhighlight(Point3d a,Point3d b){return Mesh.CreateFromCylinder(new Cylinder(new Circle(new Plane(a,b-a),.012),a.DistanceTo(b)),1,12);}
LocalBaseResult LocalBase(){
 var r=new LocalBaseResult();var aa=LBcurves(0);var bb=LBcurves(1);var uvc=LBcurves(2);double tol=1e-10;
 if(aa.Count!=bb.Count||aa.Count!=uvc.Count)throw new Exception("A/B/UV panel ownership mismatch");
 double lowV=uvc.Min(c=>c.GetBoundingBox(true).Min.Y),highV=uvc.Max(c=>c.GetBoundingBox(true).Max.Y),midU=(uvc.Min(c=>c.GetBoundingBox(true).Min.X)+uvc.Max(c=>c.GetBoundingBox(true).Max.X))/2;
 var UV=new List<Polyline>();var PA=new List<Polyline>();var PB=new List<Polyline>();var candidates=new List<LocalBaseEdge>();var below=new List<double>();
 for(int p=0;p<aa.Count;p++){
  Polyline uv,a,b;if(!uvc[p].TryGetPolyline(out uv)||!aa[p].TryGetPolyline(out a)||!bb[p].TryGetPolyline(out b)||!a.IsClosed||!b.IsClosed||a.Count!=uv.Count||b.Count!=uv.Count)throw new Exception("Native polygon/UV vertex mismatch");
  UV.Add(uv);PA.Add(a);PB.Add(b);
  for(int j=0;j<uv.Count-1;j++){
   if(Math.Abs(uv[j].Y-highV)<tol&&a[j].Z<-tol)below.Add(uv[j].X);
   if(Math.Abs(uv[j].Y-highV)<tol&&Math.Abs(uv[j+1].Y-highV)<tol&&Math.Abs(uv[j].X-uv[j+1].X)>tol)candidates.Add(new LocalBaseEdge{Panel=p,Edge=j,Lo=Math.Min(uv[j].X,uv[j+1].X),Hi=Math.Max(uv[j].X,uv[j+1].X),Mean=(a[j].Z+a[j+1].Z)/2,MidDistance=Math.Abs((uv[j].X+uv[j+1].X)/2-midU)});
  }
 }
 if(candidates.Count<3)throw new Exception("Open-side profile requires at least three panel edges");
 candidates.Sort((a,b)=>Math.Abs(a.Mean-b.Mean)>tol?a.Mean.CompareTo(b.Mean):Math.Abs(a.MidDistance-b.MidDistance)>tol?a.MidDistance.CompareTo(b.MidDistance):a.Panel!=b.Panel?a.Panel.CompareTo(b.Panel):a.Edge.CompareTo(b.Edge));
 var selected=candidates[0];double lo=selected.Lo,hi=selected.Hi;foreach(var u in below){lo=Math.Min(lo,u);hi=Math.Max(hi,u);}
 var rows=new List<string>();var profile=new List<string>();int edges=0,openFeet=0,openElevated=0,moved=0,floorPanels=0;double minBefore=Double.PositiveInfinity,minAfter=Double.PositiveInfinity,maxGround=0,maxXY=0,total=0,maxOpen=0;
 for(int p=0;p<aa.Count;p++){
  var uv=UV[p];var mask=uv.Select(q=>Math.Abs(q.Y-lowV)<tol||(Math.Abs(q.Y-highV)<tol&&q.X>=lo-tol&&q.X<=hi+tol)).ToArray();var groundPairs=new List<int>();bool ownerGround=false;
  for(int j=0;j<uv.Count-1;j++)if(mask[j]&&mask[j+1]&&Math.Abs(uv[j].Y-uv[j+1].Y)<tol&&uv[j].DistanceTo(uv[j+1])>tol){groundPairs.Add(j);ownerGround=true;if(Math.Abs(uv[j].Y-highV)<tol)openFeet++;}
  if(ownerGround)floorPanels++;
  for(int layer=0;layer<2;layer++){
   var original=layer==0?PA[p]:PB[p];var pts=new List<Point3d>();
   for(int j=0;j<original.Count;j++){
    var q=original[j];minBefore=Math.Min(minBefore,q.Z);if(mask[j]){if(q.Z!=0)moved++;q.Z=0;maxGround=Math.Max(maxGround,Math.Abs(q.Z));}
    maxXY=Math.Max(maxXY,Math.Max(Math.Abs(q.X-original[j].X),Math.Abs(q.Y-original[j].Y)));minAfter=Math.Min(minAfter,q.Z);pts.Add(q);
   }
   var result=new PolylineCurve(pts);if(!result.IsValid||!result.IsClosed)throw new Exception("Invalid corrected boundary");(layer==0?r.A:r.B).Add(result,new Grasshopper.Kernel.Data.GH_Path(0));
   foreach(int j in groundPairs){
    if(pts[j].Z!=0||pts[j+1].Z!=0||pts[j].DistanceTo(pts[j+1])<=tol)throw new Exception("Incomplete ground edge");
    var line=new LineCurve(pts[j],pts[j+1]);var path=new Grasshopper.Kernel.Data.GH_Path(p,layer);r.Ground.Add(line,path);total+=line.GetLength();edges++;
    if(Math.Abs(uv[j].Y-highV)<tol)r.Highlight.Add(LBhighlight(pts[j],pts[j+1]),path);
   }
   for(int j=0;j<uv.Count-1;j++)if(Math.Abs(uv[j].Y-highV)<tol&&Math.Abs(uv[j+1].Y-highV)<tol){
    bool foot=mask[j]&&mask[j+1];var path=new Grasshopper.Kernel.Data.GH_Path(p,layer);r.OpenProfile.Add(new LineCurve(pts[j],pts[j+1]),path);maxOpen=Math.Max(maxOpen,Math.Max(pts[j].Z,pts[j+1].Z));
    if(!foot){r.SlopeHighlight.Add(LBhighlight(pts[j],pts[j+1]),path);if(layer==0)openElevated++;}
    profile.Add("{\"panel\":\"P"+(p+1).ToString("000")+"\",\"layer\":\""+(layer==0?"A":"B")+"\",\"edge\":"+j+",\"ground\":"+(foot?"true":"false")+",\"u\":["+LBn(uv[j].X)+","+LBn(uv[j+1].X)+"],\"a\":"+LBxyz(pts[j])+",\"b\":"+LBxyz(pts[j+1])+",\"source_a\":"+LBxyz(original[j])+",\"source_b\":"+LBxyz(original[j+1])+"}");
   }
  }
  if(groundPairs.Count>0)rows.Add("{\"panel\":\"P"+(p+1).ToString("000")+"\",\"ground_edge_indices\":["+String.Join(",",groundPairs)+"]}");
 }
 if(minAfter<-1e-8||openFeet<1||openFeet>=candidates.Count||openElevated<2)throw new Exception("Local support must keep elevated open-side slopes and at least one flat foot");
 r.Meta="{\"contract\":\"GH_LOCAL_SUPPORT_BASE_Z0_V1\",\"panels\":"+aa.Count+",\"selected_open_panel\":\"P"+(selected.Panel+1).ToString("000")+"\",\"support_u_interval\":["+LBn(lo)+","+LBn(hi)+"],\"open_edge_count\":"+candidates.Count+",\"open_ground_panels\":"+openFeet+",\"open_elevated_edges\":"+openElevated+",\"max_open_elevation_m\":"+LBn(maxOpen)+",\"ground_panels\":"+floorPanels+",\"ground_edges_both_layers\":"+edges+",\"max_abs_ground_Z_m\":"+LBn(maxGround)+",\"max_XY_change_m\":"+LBn(maxXY)+",\"minimum_Z_before_m\":"+LBn(minBefore)+",\"minimum_Z_after_m\":"+LBn(minAfter)+",\"moved_vertex_occurrences\":"+moved+",\"ground_length_owner_sum_m\":"+LBn(total)+",\"ground_panel_details\":["+String.Join(",",rows)+"],\"open_profile_edges\":["+String.Join(",",profile)+"]}";
 r.Report="SISI TERBUKA \\_/ | ALAS LOKAL Z=0\nSelected foot: P"+(selected.Panel+1).ToString("000")+"; "+openFeet+" complete open-side support panels.\n"+openElevated+" open-side edges retain their rise.\nBoth A and B foot edges are exactly Z=0.\nShared UV corner corrections also reach adjacent panels.\nMain loft, X/Y and all non-foot vertices unchanged.\nYellow = rising open edge; orange = local foot (display only).\nGeometry only; no Analyze.";
 return r;
}
# ---------- end ng03_local_support_slopes_retained ----------

# ---- group: winding (continued)
divide_4 = DivideCurve(Curve=ng03_local_support_slopes_retained.B, Count=jumlah_anchor_2, Kinks=False)  # -> Points, Tangents, Parameters
divide_5 = DivideCurve(Curve=ng03_local_support_slopes_retained.A, Count=jumlah_anchor_2, Kinks=False)  # -> Points, Tangents, Parameters
sequential_winding_2 = GhPythonScript(P=divide_4.Points, Shift=shift_2, Lower=divide_5.Points)  # -> out, A, B; inputs P: tree, Shift: tree, Lower: tree; same code as sequential_winding
ln_3 = Line(StartPoint=sequential_winding_2.A, EndPoint=sequential_winding_2.B)

# ---- group: sequence
segmen_terlihat_2 = Slider(48, range=0..58)
winding_sequence_preview_2 = GhPythonScript(L=ln_3, N=segmen_terlihat_2)  # -> out, V, Total; inputs L: tree; disabled; same code as winding_sequence_preview
winding_preview_2 = Line(winding_sequence_preview_2.V)

# ---- group: SLEEVE WINDING / PRADO 2014 / GEOMETRY ONLY
satu_putaran_sleeve_native_c = CSharpScript(
    BoundaryA=ng03_local_support_slopes_retained.A,
    BoundaryB=ng03_local_support_slopes_retained.B,
    AnchorsA=divide_5.Points,
    AnchorsB=divide_4.Points,
    SourceWinding=ln_3)  # -> out, Paths, Wraps, Transfers, Mapping, Quantities, Report; inputs BoundaryA: tree, BoundaryB: tree, AnchorsA: tree, AnchorsB: tree, SourceWinding: tree
# ---------- satu_putaran_sleeve_native_c: C# usings ----------
using System;
using System.Linq;
using System.Collections.Generic;
using Rhino.Geometry;
using Grasshopper;
using Grasshopper.Kernel;
# ---------- satu_putaran_sleeve_native_c: C# ----------
var r = SleevedRoutes();
Paths = r.paths;
Wraps = r.wraps;
Transfers = r.transfers;
Mapping = r.rows;
Quantities = r.quantities;
Report = r.report;
# ---------- satu_putaran_sleeve_native_c: C# additional code ----------
class SleeveRouteResult {
 public Grasshopper.DataTree<Curve> paths=new Grasshopper.DataTree<Curve>(),wraps=new Grasshopper.DataTree<Curve>(),transfers=new Grasshopper.DataTree<Curve>();
 public List<string> rows=new List<string>(),quantities=new List<string>(); public string report;
}
List<Curve> SRcurves(int index){var rows=new List<Curve>();foreach(var g in Component.Params.Input[index].VolatileData.AllData(true)){var v=g as Grasshopper.Kernel.Types.GH_Curve;if(v==null)throw new Exception("Native boundary curve required");rows.Add(v.Value);}return rows;}
List<List<Point3d>> SRanchors(int index){var rows=new List<List<Point3d>>();var tree=Component.Params.Input[index].VolatileData;for(int i=0;i<tree.PathCount;i++){var row=new List<Point3d>();foreach(var g in tree.get_Branch(i)){var p=g as Grasshopper.Kernel.Types.GH_Point;if(p==null)throw new Exception("Native anchors required");row.Add(p.Value);}rows.Add(row);}return rows;}
Vector3d SRunit(Vector3d v){if(!v.Unitize())throw new Exception("Degenerate sleeve frame");return v;}
Point3d SRcenter(Polyline p){var c=new Point3d();for(int i=0;i<p.Count-1;i++){c.X+=p[i].X;c.Y+=p[i].Y;c.Z+=p[i].Z;}return new Point3d(c.X/(p.Count-1),c.Y/(p.Count-1),c.Z/(p.Count-1));}
Vector3d SRnormal(Polyline p){var n=new Vector3d();for(int i=0;i<p.Count-1;i++)n+=Vector3d.CrossProduct(new Vector3d(p[i]),new Vector3d(p[i+1]));return SRunit(n);}
string SRnum(double n){return n.ToString("R",System.Globalization.CultureInfo.InvariantCulture);}
string SRxyz(Point3d p){return "["+SRnum(p.X)+","+SRnum(p.Y)+","+SRnum(p.Z)+"]";}
string SRaxis(Vector3d v){return SRxyz(new Point3d(v));}
SleeveRouteResult SleevedRoutes(){
 var r=new SleeveRouteResult();var A=SRcurves(0);var B=SRcurves(1);var aa=SRanchors(2);var ab=SRanchors(3);var tree=Component.Params.Input[4].VolatileData;
 if(A.Count!=B.Count||A.Count!=aa.Count||A.Count!=ab.Count||A.Count!=tree.PathCount)throw new Exception("Panel owner/path mapping mismatch");
 double radius=.0065,linearMass=.02*.000981747704*1620,total=0,totalWrap=0,totalMass=0;int turns=0;
 for(int i=0;i<A.Count;i++){
  Polyline pa,pb;if(!A[i].TryGetPolyline(out pa)||!B[i].TryGetPolyline(out pb))throw new Exception("Polygon boundary required");var ca=SRcenter(pa);var cb=SRcenter(pb);var n=SRnormal(pa);if(n*(cb-ca)<0)n=-n;
  var source=new List<Line>();foreach(var g in tree.get_Branch(i)){var v=((Grasshopper.Kernel.Types.IGH_Goo)g).ScriptVariable();if(v is Line)source.Add((Line)v);else if(v is Curve){var c=(Curve)v;source.Add(new Line(c.PointAtStart,c.PointAtEnd));}else throw new Exception("Source line required");}
  if(source.Count==0)throw new Exception("No source winding");
  var contacts=new List<Point3d>();var circles=new List<Curve>();var visits=new List<string>();double sourceLength=0;
  for(int j=0;j<source.Count;j++){
   var s=source[j];if(s.To.DistanceTo(source[(j+1)%source.Count].From)>1e-8)throw new Exception("Source winding not continuous/closed");sourceLength+=s.Length;
   var q=s.From;int index=-1;string layer="";for(int k=0;k<ab[i].Count;k++)if(q.DistanceTo(ab[i][k])<1e-8){index=k;layer="B";break;}if(index<0)for(int k=0;k<aa[i].Count;k++)if(q.DistanceTo(aa[i][k])<1e-8){index=k;layer="A";break;}if(index<0)throw new Exception("Source visit has no owner anchor");
   var axis=layer=="A"?-n:n;var inward=(layer=="A"?ca:cb)-q;var x=SRunit(inward-axis*(inward*axis));var y=SRunit(Vector3d.CrossProduct(axis,x));var contact=q+x*radius;contacts.Add(contact);circles.Add(new Circle(new Plane(q,x,y),radius).ToNurbsCurve());
   visits.Add("{\"id\":\"P"+(i+1).ToString("000")+":"+layer+":WA"+(index+1).ToString("000")+"\",\"layer\":\""+layer+"\",\"anchor_index\":"+index+",\"center\":"+SRxyz(q)+",\"axis\":"+SRaxis(axis)+",\"x\":"+SRaxis(x)+",\"y\":"+SRaxis(y)+",\"contact\":"+SRxyz(contact)+",\"radius_m\":"+SRnum(radius)+"}");
  }
  double wrap=0,transfer=0;var path=tree.Paths[i];for(int j=0;j<source.Count;j++){var c=circles[j];var line=new LineCurve(contacts[j],contacts[(j+1)%contacts.Count]);if(c.PointAtStart.DistanceTo(contacts[j])>1e-10||c.PointAtEnd.DistanceTo(contacts[j])>1e-10)throw new Exception("Circle endpoint mismatch");r.paths.Add(c,path);r.paths.Add(line,path);r.wraps.Add(c,path);r.transfers.Add(line,path);wrap+=c.GetLength();transfer+=line.GetLength();}
  double length=wrap+transfer,mass=length*linearMass;turns+=source.Count;total+=length;totalWrap+=wrap;totalMass+=mass;
  string prefix="{\"panel\":\"P"+(i+1).ToString("000")+"\",\"source_path\":\""+path+"\",\"wrap_count\":"+source.Count+",\"source_span_length_m\":"+SRnum(sourceLength)+",\"transfer_length_m\":"+SRnum(transfer)+",\"local_wrap_length_m\":"+SRnum(wrap)+",\"total_length_m\":"+SRnum(length)+",\"mass_kg\":"+SRnum(mass)+",\"weight_N\":"+SRnum(mass*9.80665);
  r.quantities.Add(prefix+"}");r.rows.Add(prefix+",\"visits\":["+String.Join(",",visits)+"]}");
 }
 r.report="CONCEPTUAL SLEEVED WINDING / NATIVE C# GEOMETRY / FE NOT RUN\n"+A.Count+" panels / "+turns+" full turns\nTransfer + sleeve loops: "+SRnum(total)+" m\nLocal circles: "+SRnum(totalWrap)+" m\nCFRP winding: "+SRnum(totalMass)+" kg\nSleeve OD12 mm, route radius6.5 mm, one full turn per source visit.\nStraight source spans are preserved as provenance. Native loft/anchors unchanged.\nLoops and transfer contacts are schematic; tangent transition, fibre stacking/contact and robot motion unresolved.\nHardware, edge reinforcement, tails and waste excluded from mass. Fig6: separate bolted reinforced-edge connection; no permanent aluminium frame material assigned.";
 return r;
}
# ---------- end satu_putaran_sleeve_native_c ----------
winding_putaran_sleeve = CustomPreview(
    Geometry=satu_putaran_sleeve_native_c.Paths,
    Material=[{diffuse=RGB(221, 160, 221), emission=RGB(66, 48, 66), shine=0.5, specular=RGB(255, 255, 255), transparency=0}, {diffuse=RGB(55, 75, 66), emission=RGB(0, 0, 0), shine=0, specular=RGB(255, 255, 255), transparency=0}])
panjang_berat_termasuk_putaran = Panel(satu_putaran_sleeve_native_c.Report)

# ---- group: SLEEVE UNTUK WINDING / BAUT UNTUK ANTAR-MODUL | BUKAN FE
sleeve_anchor_baut_antar_modul_c = CSharpScript(
    BoundaryA=ng03_local_support_slopes_retained.A,
    BoundaryB=ng03_local_support_slopes_retained.B,
    AnchorsA=divide_5.Points,
    AnchorsB=divide_4.Points)  # -> out, Sleeves, AnchorBolts, ModuleBolts, Flanges, Mapping, Report; inputs BoundaryA: tree, BoundaryB: tree, AnchorsA: tree, AnchorsB: tree
# ---------- sleeve_anchor_baut_antar_modul_c: C# ----------
var r = HardwareHW();
Sleeves = r.sleeves;
AnchorBolts = r.anchorBolts;
ModuleBolts = r.moduleBolts;
Flanges = r.flanges;
Mapping = r.rows;
Report = r.report;
# ---------- sleeve_anchor_baut_antar_modul_c: C# additional code ----------
// Grasshopper C# Script AdditionalCode. Metres. Physical geometry is C#, not Python.
class HWResult {
 public List<Mesh> sleeves=new List<Mesh>(), anchorBolts=new List<Mesh>(), moduleBolts=new List<Mesh>(), flanges=new List<Mesh>();
 public List<string> rows=new List<string>(); public string report;
}
class EdgeHW {public int owner,edge,layer;public Point3d a,b;public Vector3d normal,inward;public List<Point3d> anchors;}
List<Curve> CurvesHW(int index) {var a=new List<Curve>();foreach(var g in Component.Params.Input[index].VolatileData.AllData(true)){var v=g as Grasshopper.Kernel.Types.GH_Curve;if(v==null)throw new Exception("Expected native curve");a.Add(v.Value);}return a;}
List<List<Point3d>> AnchorsHW(int index){var a=new List<List<Point3d>>();var t=Component.Params.Input[index].VolatileData;for(int i=0;i<t.PathCount;i++){var row=new List<Point3d>();foreach(var g in t.get_Branch(i)){var p=g as Grasshopper.Kernel.Types.GH_Point;if(p==null)throw new Exception("Expected native anchor");row.Add(p.Value);}a.Add(row);}return a;}
Vector3d UnitHW(Vector3d n){if(!n.Unitize())throw new Exception("Degenerate hardware axis");return n;}
Point3d CenterHW(Polyline p){var c=new Point3d();for(int i=0;i<p.Count-1;i++){c.X+=p[i].X;c.Y+=p[i].Y;c.Z+=p[i].Z;}return new Point3d(c.X/(p.Count-1),c.Y/(p.Count-1),c.Z/(p.Count-1));}
Vector3d NormalHW(Polyline p){var n=new Vector3d();for(int i=0;i<p.Count-1;i++)n+=Vector3d.CrossProduct(new Vector3d(p[i]),new Vector3d(p[i+1]));return UnitHW(n);}
string NumHW(double n){return n.ToString("R",System.Globalization.CultureInfo.InvariantCulture);}
string VecHW(Point3d p){return "["+NumHW(p.X)+","+NumHW(p.Y)+","+NumHW(p.Z)+"]";}
string AxisHW(Vector3d p){return VecHW(new Point3d(p));}
string PointKeyHW(Point3d p){return Math.Round(p.X/1e-8).ToString("F0",System.Globalization.CultureInfo.InvariantCulture)+","+Math.Round(p.Y/1e-8).ToString("F0",System.Globalization.CultureInfo.InvariantCulture)+","+Math.Round(p.Z/1e-8).ToString("F0",System.Globalization.CultureInfo.InvariantCulture);}
string OwnerHW(int i){return "P"+(i+1).ToString("000");}
double AnchorBoundaryErrorHW(Point3d q,Polyline p){double best=Double.MaxValue;for(int i=0;i<p.Count-1;i++){var d=p[i+1]-p[i];double t=Math.Max(0,Math.Min(1,((q-p[i])*d)/(d*d)));best=Math.Min(best,q.DistanceTo(p[i]+d*t));}return best;}
Mesh TubeHW(Point3d c,Vector3d axis,double outer,double inner,double lo,double hi,int sides){
 var plane=new Plane(c,axis);var m=new Mesh();
 foreach(double z in new double[]{lo,hi})foreach(double r in new double[]{outer,inner})for(int i=0;i<sides;i++){double a=2*Math.PI*i/sides;m.Vertices.Add(c+axis*z+plane.XAxis*(r*Math.Cos(a))+plane.YAxis*(r*Math.Sin(a)));}
 for(int i=0;i<sides;i++){int j=(i+1)%sides;m.Faces.AddFace(i,j,2*sides+j,2*sides+i);m.Faces.AddFace(sides+j,sides+i,3*sides+i,3*sides+j);m.Faces.AddFace(j,i,sides+i,sides+j);m.Faces.AddFace(2*sides+i,2*sides+j,3*sides+j,3*sides+i);}
 m.Normals.ComputeNormals();return m;
}
Mesh FlangeHW(EdgeHW e,Vector3d n){var m=new Mesh();var o=e.inward*.004;var w=e.inward*.0015;foreach(Point3d p in new Point3d[]{e.a,e.b})foreach(double z in new double[]{0,.03})foreach(double sign in new double[]{-1,1})m.Vertices.Add(p+o+w*sign+n*z);foreach(int[] f in new int[][]{new[]{0,1,3,2},new[]{4,6,7,5},new[]{0,4,5,1},new[]{2,3,7,6},new[]{0,2,6,4},new[]{1,5,7,3}})m.Faces.AddFace(f[0],f[1],f[2],f[3]);m.Normals.ComputeNormals();return m;}
HWResult HardwareHW(){
 var r=new HWResult();var A=CurvesHW(0);var B=CurvesHW(1);var aa=AnchorsHW(2);var ab=AnchorsHW(3);
 if(A.Count!=B.Count||A.Count!=aa.Count||A.Count!=ab.Count)throw new Exception("Owner/layer mapping mismatch");
 var edges=new Dictionary<string,List<EdgeHW>>();var order=new List<string>();int anchors=0;
 for(int i=0;i<A.Count;i++){
  Polyline pa,pb;if(!A[i].TryGetPolyline(out pa)||!B[i].TryGetPolyline(out pb))throw new Exception("Polyline required");var n=NormalHW(pa);if(n*(CenterHW(pb)-CenterHW(pa))<0)n=-n;
  for(int layer=0;layer<2;layer++){
   var p=layer==0?pa:pb;var outN=layer==0?-n:n;var pts=layer==0?aa[i]:ab[i];string name=layer==0?"A":"B";
   for(int k=0;k<pts.Count;k++){
    if(AnchorBoundaryErrorHW(pts[k],p)>1e-8)throw new Exception("Anchor is not on its owner/layer polygon; hold geometry output");
    var q=pts[k];var sleeve=TubeHW(q,outN,.006,.0033,-.009,.009,12);sleeve.Append(TubeHW(q,outN,.009,.0033,-.0105,-.009,12));r.sleeves.Add(sleeve);
    var stud=TubeHW(q,outN,.003,0,-.014,.022,12);stud.Append(TubeHW(q,outN,.0055,.003,.015,.019,6));r.anchorBolts.Add(stud);anchors++;
    r.rows.Add("{\"kind\":\"sleeve\",\"id\":\""+OwnerHW(i)+":"+name+":WA"+(k+1).ToString("000")+"\",\"owner\":\""+OwnerHW(i)+"\",\"layer\":\""+name+"\",\"center\":"+VecHW(q)+",\"axis\":"+AxisHW(outN)+"}");
   }
   for(int j=0;j<p.Count-1;j++){var a=p[j];var b=p[j+1];var t=UnitHW(b-a);var inward=UnitHW(Vector3d.CrossProduct(n,t));if(inward*(CenterHW(p)-(a+(b-a)*.5))<0)inward=-inward;string ka=PointKeyHW(a),kb=PointKeyHW(b),key=name+"|"+(String.CompareOrdinal(ka,kb)<0?ka+"|"+kb:kb+"|"+ka);if(!edges.ContainsKey(key)){edges[key]=new List<EdgeHW>();order.Add(key);}edges[key].Add(new EdgeHW{owner=i,edge=j,layer=layer,a=a,b=b,normal=outN,inward=inward,anchors=pts});}
  }
 }
 int shared=0,bolts=0,outer=0,unplaced=0;
 foreach(string key in order){var es=edges[key];if(es.Count>2)throw new Exception("More than two owners");var norm=es[0].normal;string jid=null;
  if(es.Count==2){var e=es[0];var s=es[1];double error=Math.Min(Math.Max(e.a.DistanceTo(s.a),e.b.DistanceTo(s.b)),Math.Max(e.a.DistanceTo(s.b),e.b.DistanceTo(s.a)));if(error>1e-8||e.owner==s.owner)throw new Exception("Not an exact shared side");jid="J"+(++shared).ToString("0000");norm=UnitHW(e.normal+s.normal);double len=e.a.DistanceTo(e.b);var placed=new List<double>();
   foreach(double t in new double[]{.25,.75,.35,.65,.15,.85,.5}){if(placed.Count==2)break;if(Math.Min(t,1-t)*len<.025||placed.Any(x=>Math.Abs(x-t)*len<.05))continue;var station=e.a+(e.b-e.a)*t;double clearance=Double.MaxValue;foreach(var p in e.anchors.Concat(s.anchors))clearance=Math.Min(clearance,p.DistanceTo(station));if(clearance<.019)continue;
    var c=station+norm*.015;var axis=e.inward;string id=jid+":MB"+(placed.Count+1);placed.Add(t);var m=TubeHW(c,axis,.003,0,-.015,.015,12);m.Append(TubeHW(c,axis,.009,.0033,-.008,-.0065,12));m.Append(TubeHW(c,axis,.009,.0033,.0065,.008,12));m.Append(TubeHW(c,axis,.0055,.003,-.013,-.009,6));m.Append(TubeHW(c,axis,.0055,.003,.009,.013,6));r.moduleBolts.Add(m);bolts++;
    r.rows.Add("{\"kind\":\"module_bolt\",\"id\":\""+id+"\",\"joint\":\""+jid+"\",\"owners\":[\""+OwnerHW(e.owner)+"\",\""+OwnerHW(s.owner)+"\"],\"layer\":\""+(e.layer==0?"A":"B")+"\",\"t\":"+NumHW(t)+",\"center\":"+VecHW(c)+",\"axis\":"+AxisHW(axis)+",\"anchor_clearance_m\":"+NumHW(clearance)+"}");
   }
   if(placed.Count==0)unplaced++;
  }else outer++;
  foreach(var e in es)r.flanges.Add(FlangeHW(e,norm));
 }
 r.report="GEOMETRY ONLY / FE NOT RUN\n"+A.Count+" panels / "+anchors+" sleeve winding anchors\n"+shared+" paired boundary sides (A and B) / "+bolts+" separate module bolts\n"+outer+" outer sides have NO intermodule bolt\n"+unplaced+" shared sides without a feasible station\nSleeve OD12 / bore6.6 / L18 mm; M6 anchor stud and independent M6 module bolts.\nThin transparent boundary connection flanges 30 x 3 mm, owner inset4 mm. Conceptual assumptions, not measured Stuttgart dimensions.\nOwner multiplicity, source polygon and winding unchanged. No FE joints, hardware mass or bolt-contact strength assigned.";
 return r;
}
# ---------- end sleeve_anchor_baut_antar_modul_c ----------
baut_anchor_winding = CustomPreview(
    Geometry=sleeve_anchor_baut_antar_modul_c.AnchorBolts,
    Material=[{diffuse=RGB(221, 160, 221), emission=RGB(66, 48, 66), shine=0.5, specular=RGB(255, 255, 255), transparency=0}, {diffuse=RGB(192, 192, 192), emission=RGB(0, 0, 0), shine=0, specular=RGB(255, 255, 255), transparency=0}])
sleeve_anchor_winding_putih = CustomPreview(
    Geometry=sleeve_anchor_baut_antar_modul_c.Sleeves,
    Material=[{diffuse=RGB(221, 160, 221), emission=RGB(66, 48, 66), shine=0.5, specular=RGB(255, 255, 255), transparency=0}, {diffuse=RGB(245, 245, 245), emission=RGB(0, 0, 0), shine=0, specular=RGB(255, 255, 255), transparency=0}])
boundary_polygon_tipis_transparan = CustomPreview(
    Geometry=sleeve_anchor_baut_antar_modul_c.Flanges,
    Material=[{diffuse=RGB(221, 160, 221), emission=RGB(66, 48, 66), shine=0.5, specular=RGB(255, 255, 255), transparency=0}, {diffuse=RGB(119, 141, 137), emission=RGB(0, 0, 0), shine=0, specular=RGB(255, 255, 255), transparency=0.78}])
baut_antar_modul_bukan_anchor = CustomPreview(
    Geometry=sleeve_anchor_baut_antar_modul_c.ModuleBolts,
    Material=[{diffuse=RGB(221, 160, 221), emission=RGB(66, 48, 66), shine=0.5, specular=RGB(255, 255, 255), transparency=0}, {diffuse=RGB(184, 111, 44), emission=RGB(0, 0, 0), shine=0, specular=RGB(255, 255, 255), transparency=0}])
sistem_dua_hardware_geometry_only = Panel(sleeve_anchor_baut_antar_modul_c.Report)

# ----
ng01_geometri_fe_native_c = CSharpScript(
    BoundaryA=ng03_local_support_slopes_retained.A,
    BoundaryB=ng03_local_support_slopes_retained.B,
    AnchorsA=divide_5.Points,
    AnchorsB=divide_4.Points,
    SleevedTransfers=satu_putaran_sleeve_native_c.Transfers)  # -> out, Meshes, Axes, Names, Height, IndexMap, AssemblyPts, FrameLines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; inputs BoundaryA: tree, BoundaryB: tree, AnchorsA: tree, AnchorsB: tree, SleevedTransfers: tree
# ---------- ng01_geometri_fe_native_c: C# ----------
var r=BuildNativeFEGeometry();
Meshes = r.Meshes;
Axes = r.Axes;
Names = r.Names;
Height = r.Height;
IndexMap = r.IndexMap;
AssemblyPts = r.AssemblyPts;
FrameLines = r.FrameLines;
FrameNames = r.FrameNames;
LinkLines = r.LinkLines;
LinkNames = r.LinkNames;
SupportP = r.SupportP;
LoadP = r.LoadP;
LoopP = r.LoopP;
Meta = r.Meta;
Report = r.Report;
FramePts = r.FramePts;
# ---------- ng01_geometri_fe_native_c: C# additional code ----------
// Geometry only. Native Karamba components create elements, assemble and analyze.
class NFResult {
 public Grasshopper.DataTree<object> Meshes=new Grasshopper.DataTree<object>(),Axes=new Grasshopper.DataTree<object>(),Names=new Grasshopper.DataTree<object>(),Height=new Grasshopper.DataTree<object>(),IndexMap=new Grasshopper.DataTree<object>(),AssemblyPts=new Grasshopper.DataTree<object>(),FrameLines=new Grasshopper.DataTree<object>(),FrameNames=new Grasshopper.DataTree<object>(),LinkLines=new Grasshopper.DataTree<object>(),LinkNames=new Grasshopper.DataTree<object>(),SupportP=new Grasshopper.DataTree<object>(),LoadP=new Grasshopper.DataTree<object>(),LoopP=new Grasshopper.DataTree<object>();
 public Grasshopper.DataTree<object> FramePts=new Grasshopper.DataTree<object>();public string Meta,Report;
}
List<Point3d> nfPoints=new List<Point3d>();Dictionary<string,List<int>> nfGrid=new Dictionary<string,List<int>>();
string NFkey(Point3d p){return Math.Round(p.X/1e-8)+","+Math.Round(p.Y/1e-8)+","+Math.Round(p.Z/1e-8);}
int NFfind(Point3d p){long x=(long)Math.Round(p.X/1e-8),y=(long)Math.Round(p.Y/1e-8),z=(long)Math.Round(p.Z/1e-8);for(int a=-1;a<=1;a++)for(int b=-1;b<=1;b++)for(int c=-1;c<=1;c++){List<int> ids;if(nfGrid.TryGetValue((x+a)+","+(y+b)+","+(z+c),out ids))foreach(var i in ids)if(nfPoints[i].DistanceTo(p)<1e-8)return i;}return -1;}
int NFframe(Point3d p){int i=NFfind(p);if(i>=0)return i;i=nfPoints.Count;nfPoints.Add(p);string k=NFkey(p);if(!nfGrid.ContainsKey(k))nfGrid[k]=new List<int>();nfGrid[k].Add(i);return i;}
string NFn(double x){return x.ToString("R",System.Globalization.CultureInfo.InvariantCulture);}
string NFxyz(Point3d p){return "["+NFn(p.X)+","+NFn(p.Y)+","+NFn(p.Z)+"]";}
List<Curve> NFcurves(int index){return Component.Params.Input[index].VolatileData.AllData(true).Select(g=>((Grasshopper.Kernel.Types.GH_Curve)g).Value).ToList();}
List<List<Point3d>> NFanchors(int index){var t=Component.Params.Input[index].VolatileData;var r=new List<List<Point3d>>();for(int i=0;i<t.PathCount;i++)r.Add(t.get_Branch(i).Cast<Grasshopper.Kernel.Types.IGH_Goo>().Select(g=>((Grasshopper.Kernel.Types.GH_Point)g).Value).ToList());return r;}
NFResult BuildNativeFEGeometry(){
 nfPoints.Clear();nfGrid.Clear();var r=new NFResult();var A=NFcurves(0);var B=NFcurves(1);var aa=NFanchors(2);var ab=NFanchors(3);var tr=Component.Params.Input[4].VolatileData;
 if(A.Count!=B.Count||A.Count!=tr.PathCount||A.Count!=aa.Count||A.Count!=ab.Count)throw new Exception("Native owner tree mismatch");
 int ns=2,nw=2;double width=.02,thick=.000981747704,radius=.0065;
 var polygons=new List<Polyline[]>();var spans=new List<List<Line>>();var normals=new List<Vector3d>();var contactIndices=new List<List<int>>();int wraps=0;
 for(int p=0;p<A.Count;p++){
  Polyline a,b;if(!A[p].TryGetPolyline(out a)||!B[p].TryGetPolyline(out b))throw new Exception("Native polygon required");polygons.Add(new[]{a,b});
  var normal=Vector3d.Zero;for(int j=0;j<a.Count-1;j++)normal+=Vector3d.CrossProduct(new Vector3d(a[j]),new Vector3d(a[j+1]));if(!normal.Unitize())throw new Exception("Panel normal undefined");normals.Add(normal);
  foreach(var pl in new[]{a,b})foreach(var q in pl)NFframe(q);foreach(var q in aa[p])NFframe(q);foreach(var q in ab[p])NFframe(q);
  var lines=new List<Line>();foreach(Grasshopper.Kernel.Types.IGH_Goo g in tr.get_Branch(p)){var v=g.ScriptVariable();Curve c=v as Curve;Line line=v is Line?(Line)v:new Line(c.PointAtStart,c.PointAtEnd);if(line.Length<1e-8)throw new Exception("Zero transfer");lines.Add(line);}spans.Add(lines);
 }
 // Each transfer starts at one visited sleeve contact. The closed sequence uses it once.
 for(int p=0;p<A.Count;p++){
  var ids=new List<int>();var visited=new HashSet<int>();var anchors=aa[p].Concat(ab[p]).ToList();
  for(int j=0;j<spans[p].Count;j++){
   var line=spans[p][j];if(line.To.DistanceTo(spans[p][(j+1)%spans[p].Count].From)>1e-8)throw new Exception("Transfer sequence is not closed");
   var q=line.From;int a=Enumerable.Range(0,anchors.Count).OrderBy(i=>anchors[i].DistanceTo(q)).First();
   if(Math.Abs(anchors[a].DistanceTo(q)-radius)>1e-8||!visited.Add(a))throw new Exception("Sleeve contact ownership mismatch");
   int index=NFframe(q);ids.Add(index);r.LinkLines.Add(new Line(anchors[a],q),new Grasshopper.Kernel.Data.GH_Path(0));r.LinkNames.Add("NG_LINK_P"+(p+1).ToString("000")+"_V"+(j+1).ToString("000"),new Grasshopper.Kernel.Data.GH_Path(0));r.LoopP.Add(anchors[a],new Grasshopper.Kernel.Data.GH_Path(0));wraps++;
  }contactIndices.Add(ids);
 }
 int frameCount=nfPoints.Count,frameSegments=0,groundEdges=0;var groundNodes=new HashSet<int>();var loadNodes=new HashSet<int>();double zmin=nfPoints.Min(q=>q.Z),zmax=nfPoints.Max(q=>q.Z);double boundaryLength=0;
 var distinct=new HashSet<string>();
 for(int p=0;p<polygons.Count;p++)for(int layer=0;layer<2;layer++){
  var pl=polygons[p][layer];int part=0;
  for(int j=0;j<pl.Count-1;j++){
   Point3d a=pl[j],b=pl[j+1];Vector3d d=b-a;double L=d.Length;if(L<1e-8)continue;
   var stations=new List<Tuple<double,int>>();for(int i=0;i<frameCount;i++){double t=((nfPoints[i]-a)*d)/(L*L);if(t>=-1e-8&&t<=1+1e-8&&nfPoints[i].DistanceTo(a+d*t)<1e-8)stations.Add(Tuple.Create(Math.Max(0,Math.Min(1,t)),i));}stations.Sort((u,v)=>u.Item1.CompareTo(v.Item1));
   bool ground=Math.Abs(a.Z)<1e-8&&Math.Abs(b.Z)<1e-8;if(ground){groundEdges++;foreach(var s in stations)groundNodes.Add(s.Item2);}
   for(int k=0;k<stations.Count-1;k++){int i=stations[k].Item2,h=stations[k+1].Item2;if(i==h)continue;var line=new Line(nfPoints[i],nfPoints[h]);r.FrameLines.Add(line,new Grasshopper.Kernel.Data.GH_Path(0));r.FrameNames.Add("NG_EDGE_P"+(p+1).ToString("000")+"_"+(layer==0?"A":"B")+"_S"+(++part).ToString("000"),new Grasshopper.Kernel.Data.GH_Path(0));frameSegments++;boundaryLength+=line.Length;distinct.Add(Math.Min(i,h)+","+Math.Max(i,h));}
  }
  // Lateral load locations: actual original-A polygon vertices in upper 75% of pavilion.
  if(layer==0)foreach(var q in pl)if(q.Z>zmin+.25*(zmax-zmin))loadNodes.Add(NFfind(q));
 }
 if(groundNodes.Count<3||groundEdges==0)throw new Exception("No distributed Z=0 ground-boundary support chain");
 foreach(var i in groundNodes.OrderBy(i=>i))r.SupportP.Add(nfPoints[i],new Grasshopper.Kernel.Data.GH_Path(0));
 foreach(var i in loadNodes.OrderBy(i=>i)){if(i<0)throw new Exception("Load station unmapped");r.LoadP.Add(nfPoints[i],new Grasshopper.Kernel.Data.GH_Path(0));}
 foreach(var q in nfPoints){r.AssemblyPts.Add(q,new Grasshopper.Kernel.Data.GH_Path(0,0));r.FramePts.Add(q,new Grasshopper.Kernel.Data.GH_Path(0));}
 int master=frameCount,count=0,triangles=0;double total=0;var records=new List<string>();
 for(int p=0;p<spans.Count;p++){
  var path=new Grasshopper.Kernel.Data.GH_Path(p,0);var patch=new Mesh();patch.Vertices.UseDoublePrecisionVertices=true;var routes=new List<string>();
  for(int s=0;s<spans[p].Count;s++){
   Line line=spans[p][s];var dir=line.Direction;dir.Unitize();var across=Vector3d.CrossProduct(normals[p],dir);if(!across.Unitize())throw new Exception("Ribbon axis undefined");int start=patch.Vertices.Count,faceBegin=patch.Faces.Count;
   for(int j=0;j<=ns;j++)for(int c=0;c<=nw;c++){
    Point3d q=line.PointAt((double)j/ns)+across*(((double)c/nw-.5)*width);patch.Vertices.Add(q);int index;
    if((j==0||j==ns)&&c==nw/2)index=contactIndices[p][j==0?s:(s+1)%spans[p].Count];else{index=master++;r.AssemblyPts.Add(q,new Grasshopper.Kernel.Data.GH_Path(1,p));}
    r.IndexMap.Add(index,path);
   }
   for(int j=0;j<ns;j++)for(int c=0;c<nw;c++){int k=start+j*(nw+1)+c,h=k+nw+1;patch.Faces.AddFace(k,h,h+1);patch.Faces.AddFace(k,h+1,k+1);r.Axes.Add(dir,path);r.Axes.Add(dir,path);}
   routes.Add("{\"strand\":"+s+",\"face_begin\":"+faceBegin+",\"face_count\":"+(2*ns*nw)+",\"length_m\":"+NFn(line.Length)+",\"start\":"+NFxyz(line.From)+",\"end\":"+NFxyz(line.To)+"}");total+=line.Length;count++;
  }
  patch.Normals.ComputeNormals();string name="NG_P"+(p+1).ToString("000")+"_F0";r.Meshes.Add(patch,path);r.Names.Add(name,path);r.Height.Add(thick*100,path);triangles+=patch.Faces.Count;
  records.Add("{\"name\":\""+name+"\",\"panel\":"+p+",\"family\":0,\"faces\":"+patch.Faces.Count+",\"routes\":["+String.Join(",",routes)+"]}");
 }

 // Reinforcement geometry uses only native RhinoCommon and explicit native node ownership.
 int[] targetPanels=new int[]{0,8,82};int[][] repeated=new int[][]{new int[]{25,24},new int[]{16,20},new int[]{0,13}};
 double addedLength=0;int addedFaces=0;var turnNodes=new List<int>();var additionRecords=new List<string>();
 for(int ti=0;ti<targetPanels.Length;ti++){
  int p=targetPanels[ti];var basePath=new Grasshopper.Kernel.Data.GH_Path(p,0);var path=new Grasshopper.Kernel.Data.GH_Path(p,1);
  Mesh original=(Mesh)r.Meshes.Branch(basePath)[0];var originalMap=r.IndexMap.Branch(basePath).Select(x=>Convert.ToInt32(x)).ToList();
  var patch=new Mesh();patch.Vertices.UseDoublePrecisionVertices=true;var routes=new List<string>();
  var lines=new List<Line>();var starts=new List<int>();var ends=new List<int>();var originalStrands=new List<int>();
  if(false){foreach(int strand in repeated[ti]){lines.Add(spans[p][strand]);starts.Add(originalMap[strand*9+1]);ends.Add(originalMap[strand*9+7]);originalStrands.Add(strand);}}
  else{
   int pv=repeated[ti][0]*9+4;Point3d pivot=original.Vertices.Point3dAt(pv);int pivotIndex=originalMap[pv];
   int ai=-1,bi=-1;double best=-1;
   for(int a=0;a<spans[p].Count;a++)for(int b=0;b<spans[p].Count;b++){
    var qa=spans[p][a].From;var qb=spans[p][b].From;
    bool aLayer=aa[p].Any(q=>Math.Abs(q.DistanceTo(qa)-radius)<1e-8),bLayer=ab[p].Any(q=>Math.Abs(q.DistanceTo(qb)-radius)<1e-8);
    if(!aLayer||!bLayer)continue;double score=Vector3d.CrossProduct(qa-pivot,qb-pivot).Length;
    if(score>best){best=score;ai=a;bi=b;}
   }
   if(ai<0||bi<0||best<1e-8)throw new Exception("No valid new anchor distribution triangle");
   Point3d a0=spans[p][ai].From,b0=spans[p][bi].From;
   int aIndex=contactIndices[p][ai],bIndex=contactIndices[p][bi];
   lines.Add(new Line(a0,pivot));starts.Add(aIndex);ends.Add(pivotIndex);originalStrands.Add(-1);
   lines.Add(new Line(pivot,b0));starts.Add(pivotIndex);ends.Add(bIndex);originalStrands.Add(-1);
   lines.Add(new Line(b0,a0));starts.Add(bIndex);ends.Add(aIndex);originalStrands.Add(-1);
  }
  for(int s=0;s<lines.Count;s++){
   Line line=lines[s];Vector3d dir=line.Direction;dir.Unitize();int start=patch.Vertices.Count,faceBegin=patch.Faces.Count;
   var across=Vector3d.CrossProduct(normals[p],dir);if(!across.Unitize())throw new Exception("Additional ribbon axis undefined");
   for(int j=0;j<=ns;j++)for(int c=0;c<=nw;c++){
    Point3d q;int index;
    if(false){int vi=originalStrands[s]*9+j*3+c;q=original.Vertices.Point3dAt(vi);index=originalMap[vi];}
    else{q=line.PointAt((double)j/ns)+across*(((double)c/nw-.5)*width);if((j==0||j==ns)&&c==1)index=j==0?starts[s]:ends[s];else{index=master++;r.AssemblyPts.Add(q,new Grasshopper.Kernel.Data.GH_Path(2,p));}}
    patch.Vertices.Add(q);r.IndexMap.Add(index,path);
   }
   for(int j=0;j<ns;j++)for(int c=0;c<nw;c++){int k=start+j*3+c,h=k+3;patch.Faces.AddFace(k,h,h+1);patch.Faces.AddFace(k,h+1,k+1);r.Axes.Add(dir,path);r.Axes.Add(dir,path);}
   turnNodes.Add(starts[s]);if(false)turnNodes.Add(ends[s]);
   routes.Add("{\"strand\":"+s+",\"face_begin\":"+faceBegin+",\"face_count\":8,\"length_m\":"+NFn(line.Length)+",\"start\":"+NFxyz(line.From)+",\"end\":"+NFxyz(line.To)+"}");addedLength+=line.Length;
  }
  patch.Normals.ComputeNormals();string name="NG_P"+(p+1).ToString("000")+"_F1";r.Meshes.Add(patch,path);r.Names.Add(name,path);r.Height.Add(thick*100,path);addedFaces+=patch.Faces.Count;
  records.Add("{\"name\":\""+name+"\",\"panel\":"+p+",\"family\":1,\"faces\":"+patch.Faces.Count+",\"routes\":["+String.Join(",",routes)+"]}");
 }
 triangles+=addedFaces;total+=addedLength;count+=false?6:9;

 double loopLength=wraps*2*Math.PI*radius;
 r.Meta="{\"schema\":\"GH_NEW_NATIVE_FE_GEOMETRY/1\",\"panels\":"+A.Count+",\"explicit_master_nodes\":"+master+",\"frame_seed_nodes\":"+frameCount+",\"triangles\":"+triangles+",\"strands\":"+count+",\"frame_segments\":"+frameSegments+",\"distinct_frame_segments\":"+distinct.Count+",\"equivalent_sleeve_links\":"+wraps+",\"wrap_count\":"+wraps+",\"ground_edges\":"+groundEdges+",\"support_count\":"+groundNodes.Count+",\"load_nodes\":"+loadNodes.Count+",\"zmin_m\":"+NFn(zmin)+",\"zmax_m\":"+NFn(zmax)+",\"transfer_length_m\":"+NFn(total)+",\"local_wrap_length_m\":"+NFn(loopLength)+",\"boundary_length_m\":"+NFn(boundaryLength)+",\"width_m\":"+NFn(width)+",\"thickness_m\":"+NFn(thick)+",\"records\":["+String.Join(",",records)+"]}";
 r.Meta=r.Meta.Substring(0,r.Meta.Length-1)+",\"reinforcement_mode\":\"NEW_ANCHOR\",\"additional_transfer_length_m\":"+NFn(addedLength)+",\"reinforcement_turn_nodes\":["+String.Join(",",turnNodes)+"],\"additional_turn_count\":"+turnNodes.Count+"}";
 r.Report="NATIVE C# GLOBAL FE GEOMETRY / ANALYZE NOT RUN\n"+A.Count+" panels; "+count+" straight sleeve-contact spans; "+triangles+" shell triangles.\n"+frameSegments+" owner boundary beam segments; "+wraps+" local equivalent sleeve links.\n"+groundNodes.Count+" translation supports on "+groundEdges+" ground boundary edges at Z=0.\n"+loadNodes.Count+" lateral stations, total 1 kN per direction.\nLocal circles supply lumped self-weight only; contact/bolt stress excluded.\nSource loft, panels, anchor sequence and physical sleeve routes unchanged.";
 return r;
}
# ---------- end ng01_geometri_fe_native_c ----------
ng02_winding_on_corrected_boundary = CustomPreview(
    Geometry=satu_putaran_sleeve_native_c.Paths,
    Material=[{diffuse=RGB(221, 160, 221), emission=RGB(66, 48, 66), shine=0.5, specular=RGB(255, 255, 255), transparency=0}, {diffuse=RGB(110, 130, 120), emission=RGB(0, 0, 0), shine=0, specular=RGB(255, 255, 255), transparency=0}])
ng02_corrected_boundary_polygons = CustomPreview(
    Geometry=[ng03_local_support_slopes_retained.A, ng03_local_support_slopes_retained.B],
    Material=[{diffuse=RGB(221, 160, 221), emission=RGB(66, 48, 66), shine=0.5, specular=RGB(255, 255, 255), transparency=0}, {diffuse=RGB(50, 70, 60), emission=RGB(0, 0, 0), shine=0, specular=RGB(255, 255, 255), transparency=0}])
ng02_orange_flat_ground_edges_z_0 = CustomPreview(
    Geometry=ng02_boundary_alas_datar_z_0_native_c.GroundEdges,
    Material=[{diffuse=RGB(221, 160, 221), emission=RGB(66, 48, 66), shine=0.5, specular=RGB(255, 255, 255), transparency=0}, {diffuse=RGB(240, 100, 25), emission=RGB(0, 0, 0), shine=0, specular=RGB(255, 255, 255), transparency=0}])
ng02_orange_highlight_only_not_structura = CustomPreview(
    Geometry=ng02_boundary_alas_datar_z_0_native_c.GroundHighlight,
    Material=[{diffuse=RGB(221, 160, 221), emission=RGB(66, 48, 66), shine=0.5, specular=RGB(255, 255, 255), transparency=0}, {diffuse=RGB(255, 105, 20), emission=RGB(0, 0, 0), shine=0, specular=RGB(255, 255, 255), transparency=0}])  # "NG02 ORANGE HIGHLIGHT ONLY | not structural section"
shell_const_2 = CrossSectionsShellKaramba3D(
    FamilyNameOfCrossSection="SPATIAL UD RIBBON",
    NameOfCrossSection=ng01_geometri_fe_native_c.Names,
    Material=orthotropic_2,
    Height_cm=ng01_geometri_fe_native_c.Height,
    mode="Shell - Const")  # -> CrossSection, CentreOfGravity
ng02_alas_datar_z_0_geometri = Panel(ng02_boundary_alas_datar_z_0_native_c.Report)
linetobeam = CreateLinearElementKaramba3D(
    Line=ng01_geometri_fe_native_c.FrameLines,
    Identifier=ng01_geometri_fe_native_c.FrameNames,
    CrossSection=o_section.CrossSection,
    LimitDistance_m=1e-08,
    BucklingLengthY_m=-1,
    BucklingLengthZ_m=-1,
    BucklingLengthLT_m=-1,
    Bending=True,
    ToPolylineMaxAngle=0.25,
    ToPolylineTolerance=0.1,
    ToPolylineMaxEdgeLength=0.25,
    New=True,
    Remove=False,
    mode="LineToBeam",
    GuidGeneratorSeed=1489398378)  # -> Element, Points, Info
linetobeam_2 = CreateLinearElementKaramba3D(
    Line=ng01_geometri_fe_native_c.LinkLines,
    Identifier=ng01_geometri_fe_native_c.LinkNames,
    CrossSection=o_section_2.CrossSection,
    LimitDistance_m=1e-08,
    BucklingLengthY_m=-1,
    BucklingLengthZ_m=-1,
    BucklingLengthLT_m=-1,
    Bending=True,
    ToPolylineMaxAngle=0.25,
    ToPolylineTolerance=0.1,
    ToPolylineMaxEdgeLength=0.25,
    New=True,
    Remove=False,
    mode="LineToBeam",
    GuidGeneratorSeed=-215428576)  # -> Element, Points, Info
mesh_to_shell_2 = MeshToShellKaramba3D(
    Mesh=ng01_geometri_fe_native_c.Meshes,
    Identifier=ng01_geometri_fe_native_c.Names,
    CrossSection=shell_const_2.CrossSection,
    LimitDistance_m=1e-08,
    Bending=True,
    GuidGeneratorSeed=330777105)  # -> Element, Points, Info
supp_4 = SupportKaramba3D(
    PosInd=ng01_geometri_fe_native_c.SupportP,
    Ct_kN_m=Vector(0, 0, 0),
    Cr_kNm_rad=Vector(0, 0, 0),
    Dofs=[0, 1, 2],
    menu=[buttons(off, off, off, off, off, off)])
shell_2 = OrientateElemKaramba3D(Shell=mesh_to_shell_2.Element, XOrientations=ng01_geometri_fe_native_c.Axes, mode="Shell")
pointload_2 = LoadsKaramba3D(ForceVector=Vector(0, 0, -3.676001262e-05), Local=False, PosInd=ng01_geometri_fe_native_c.LoopP, LCase="G", mode="Point")
pointload_3 = LoadsKaramba3D(
    ForceVector=Vector(0, 0, -3.676001262e-05),
    Local=False,
    PosInd=ng01_geometri_fe_native_c.LoopP,
    LCase="G_X_POS",
    mode="Point")
pointload_4 = LoadsKaramba3D(
    ForceVector=Vector(0, 0, -3.676001262e-05),
    Local=False,
    PosInd=ng01_geometri_fe_native_c.LoopP,
    LCase="G_X_NEG",
    mode="Point")
pointload_5 = LoadsKaramba3D(
    ForceVector=Vector(0, 0, -3.676001262e-05),
    Local=False,
    PosInd=ng01_geometri_fe_native_c.LoopP,
    LCase="G_Y_POS",
    mode="Point")
pointload_6 = LoadsKaramba3D(
    ForceVector=Vector(0, 0, -3.676001262e-05),
    Local=False,
    PosInd=ng01_geometri_fe_native_c.LoopP,
    LCase="G_Y_NEG",
    mode="Point")

# ---- group: 16 | ACTIVE SEQUENCE FE - original geometry and node ownership
material_screening_safety_factor = Panel("2")  # disabled
ribbon_width_mm_assumed = Panel("20")
ribbon_ns_numerical_refinement = Slider(8, range=1..32)  # disabled
ribbon_nw_even = Panel("2")  # disabled
reference_lateral_x_kn = Panel("1")  # disabled
ribbon_thickness_mm_equivalent = Panel("0.981747704")
sequence_cfrp_owned_ribbons = GhPythonScript(
    A=ng03_local_support_slopes_retained.B,
    B=ng03_local_support_slopes_retained.A,
    Winding=ln_3,
    WidthMM=ribbon_width_mm_assumed,
    ThicknessMM=ribbon_thickness_mm_equivalent,
    Ns=ribbon_ns_numerical_refinement,
    Nw=ribbon_nw_even,
    LoadKN=reference_lateral_x_kn)  # -> Meshes, Axes, Names, Height, Meta, Report, ExactPts, AssemblyPts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; inputs A: tree, B: tree, Winding: tree; disabled
# ---------- sequence_cfrp_owned_ribbons: Python ----------
import math,json,Rhino.Geometry as rg
from Grasshopper import DataTree
from Grasshopper.Kernel.Data import GH_Path
def val(v):return v.Value if hasattr(v,'Value') else v
def xyz(p):return [float(p.X),float(p.Y),float(p.Z)]
def integer(v):
 x=float(val(v));n=int(x)
 if x!=n or n<1:raise ValueError('Positive integer refinement required.')
 return n
ns=integer(Ns);nw=integer(Nw);width=float(val(WidthMM))*.001;thickness=float(val(ThicknessMM))*.001
if nw%2 or width<=0 or thickness<=0:raise ValueError('Even width subdivision and positive tow dimensions required.')
aa=[val(v) for v in A.AllData()];bb=[val(v) for v in B.AllData()];paths=list(Winding.Paths)
if len(aa)!=len(bb) or len(paths)!=len(aa):raise ValueError('One A/B pair per sequence panel is required.')
poly=[];panel_normals=[];MetricA=DataTree[object]();MetricB=DataTree[object]()
for p,(a,b) in enumerate(zip(aa,bb)):
 pair=[]
 for c in [a,b]:
  ok,pl=c.TryGetPolyline()
  if not ok or not c.IsClosed:raise ValueError('Closed existing boundary polylines required.')
  pair.append(list(pl))
 n=rg.Vector3d.Zero
 for j in range(len(pair[1])-1):n+=rg.Vector3d.CrossProduct(pair[1][j]-pair[1][0],pair[1][j+1]-pair[1][0])
 if not n.Unitize():raise ValueError('Panel normal undefined.')
 poly.append(pair);panel_normals.append(n)
 MetricA.Add(a,GH_Path(p));MetricB.Add(b,GH_Path(p))
framepoints=[];grid={};tol=1e-9
def existing(p):
 cell=tuple(int(math.floor(getattr(p,k)/tol)) for k in ['X','Y','Z'])
 for dx in [-1,0,1]:
  for dy in [-1,0,1]:
   for dz in [-1,0,1]:
    for i in grid.get((cell[0]+dx,cell[1]+dy,cell[2]+dz),[]):
     if framepoints[i].DistanceTo(p)<=tol:return i
 return None
def frame(p):
 i=existing(p)
 if i is not None:return i
 cell=tuple(int(math.floor(getattr(p,k)/tol)) for k in ['X','Y','Z']);i=len(framepoints);framepoints.append(rg.Point3d(p));grid.setdefault(cell,[]).append(i);return i
for pair in poly:
 for pl in pair:
  for p in pl:frame(p)
lines=[]
for panel,path in enumerate(paths):
 branch=[]
 for item in Winding.Branch(path):
  l=val(item);a=l.From if hasattr(l,'From') else l.PointAtStart;b=l.To if hasattr(l,'To') else l.PointAtEnd
  if a.DistanceTo(b)<=1e-8:raise ValueError('Zero-length winding segment.')
  for p in [a,b]:
   distances=[]
   for c in [aa[panel],bb[panel]]:
    ok,t=c.ClosestPoint(p);distances.append(c.PointAt(t).DistanceTo(p) if ok else 1e10)
   distance=min(distances)
   if distance>1e-7:raise ValueError('Sequence endpoint is not on its own A/B boundary.')
  branch.append((rg.Point3d(a),rg.Point3d(b)));frame(a);frame(b)
 lines.append(branch)
frame_count=len(framepoints);edges=set();FrameLines=DataTree[object]()
for pair in poly:
 for pl in pair:
  for a,b in zip(pl[:-1],pl[1:]):
   d=b-a;length=d.Length
   if length<1e-8:continue
   stations=[]
   for i,p in enumerate(framepoints):
    t=((p-a)*d)/(length*length)
    if -1e-8<=t<=1+1e-8 and p.DistanceTo(a+d*t)<1e-8:stations.append((max(0,min(1,t)),i))
   stations.sort()
   for (_,i),(_,j) in zip(stations[:-1],stations[1:]):
    if i==j:continue
    key=tuple(sorted([i,j]))
    if key not in edges:edges.add(key);FrameLines.Add(rg.Line(framepoints[i],framepoints[j]),GH_Path(0))
used=set(i for e in edges for i in e)
if used!=set(range(frame_count)):raise ValueError('Boundary endpoint not integrated into frame edges.')
AssemblyPts=DataTree[object]();ExactPts=DataTree[object]();IndexMap=DataTree[object]();Meshes=DataTree[object]();Axes=DataTree[object]();Names=DataTree[object]();Height=DataTree[object]()
FramePts=DataTree[object]()
for p in framepoints:
 AssemblyPts.Add(p,GH_Path(-1));FramePts.Add(p,GH_Path(0))
master=frame_count;records=[];volume=0.;total=0.;count=0;maxaspect=0.
for panel,branch in enumerate(lines):
 path=GH_Path(panel,0);patch=rg.Mesh();patch.Vertices.UseDoublePrecisionVertices=True;routes=[];normal=panel_normals[panel]
 for strand,(a,b) in enumerate(branch):
  direction=b-a;length=direction.Length;direction.Unitize();across=rg.Vector3d.CrossProduct(normal,direction)
  if not across.Unitize():raise ValueError('Ribbon width direction undefined.')
  stripnormal=rg.Vector3d.CrossProduct(direction,across);stripnormal.Unitize();start=patch.Vertices.Count;face_begin=patch.Faces.Count
  fractions=[j/float(ns) for j in range(ns+1)]
  for j,t in enumerate(fractions):
   centre=a+(b-a)*t
   for c in range(nw+1):
    p=centre+across*((c/float(nw)-.5)*width);patch.Vertices.Add(p);ExactPts.Add(p,path)
    if j in [0,ns] and c==nw//2:index=existing(centre)
    else:index=master;master+=1;AssemblyPts.Add(p,path)
    if index is None:raise ValueError('Ribbon end lacks a matching frame node.')
    IndexMap.Add(index,path)
  for j in range(ns):
   for c in range(nw):
    k=start+j*(nw+1)+c;nxt=k+nw+1
    for ids in [(k,nxt,nxt+1),(k,nxt+1,k+1)]:patch.Faces.AddFace(*ids);Axes.Add(direction,path)
  route_volume=length*width*thickness;aspect=length/ns/(width/nw);maxaspect=max(maxaspect,aspect)
  routes.append(dict(strand=strand,face_begin=face_begin,face_count=2*ns*nw,vertex_begin=start,vertex_count=(ns+1)*(nw+1),center_endpoint_vertices=[start+nw//2,start+ns*(nw+1)+nw//2],length_m=length,volume_m3=route_volume,start=xyz(a),end=xyz(b),direction=xyz(direction),normal=xyz(stripnormal),station_fractions=fractions,max_cell_aspect=aspect))
  total+=length;volume+=route_volume;count+=1
 patch.Normals.ComputeNormals();name='SPATIAL_UD_P%d_F0'%panel
 Meshes.Add(patch,path);Names.Add(name,path);Height.Add(thickness*100,path)
 records.append(dict(name=name,panel=panel,family=0,source_path=str(paths[panel]),width_m=width,thickness_m=thickness,faces=patch.Faces.Count,routes=routes))
zmin=min(p.Z for p in framepoints);ground=[i for i,p in enumerate(framepoints) if abs(p.Z-zmin)<1e-8]
if len(ground)<4:raise ValueError('Four ground corner nodes cannot be inferred; specify supports.')
xmin=min(framepoints[i].X for i in ground);xmax=max(framepoints[i].X for i in ground);ymin=min(framepoints[i].Y for i in ground);ymax=max(framepoints[i].Y for i in ground)
supportids=[]
for x in [xmin,xmax]:
 endnodes=[i for i in ground if abs(framepoints[i].X-x)<1e-8]
 if len(endnodes)<2:raise ValueError('Each pavilion end requires two ground corners.')
 for i in [min(endnodes,key=lambda i:framepoints[i].Y),max(endnodes,key=lambda i:framepoints[i].Y)]:
  if i in supportids:raise ValueError('Ground corner support selection is not unique.')
  supportids.append(i)
SupportP=DataTree[object]();LoadP=DataTree[object]();LoadV=DataTree[object]()
for i in supportids:SupportP.Add(framepoints[i],GH_Path(0))
roof=set()
zmax=max(p.Z for p in framepoints)
for pair in poly:
 for p in pair[0]:
  if p.Z>zmin+.25*(zmax-zmin):roof.add(existing(p))
if not roof:raise ValueError('No roof nodes for reference lateral load.')
force=float(val(LoadKN))
for i in sorted(roof):LoadP.Add(framepoints[i],GH_Path(0));LoadV.Add(rg.Vector3d(force/len(roof),0,0),GH_Path(0))
Meta=json.dumps(dict(mesh_method='sequence_uniform_owned_ModelShell_LDist1e-6',explicit_master_nodes=master,frame_seed_nodes=frame_count,width_m=width,segments=ns,width_divisions=nw,strands=count,triangles=count*2*ns*nw,volume_m3=volume,total_length_m=total,max_aspect=maxaspect,max_nominal_aspect=maxaspect,records=records,panels=len(poly),frame_segments=len(edges),support_indices=supportids,support_points=[xyz(framepoints[i]) for i in supportids],load_nodes=len(roof),reference_force_kN=[force,0,0],source_geometry_preserved=True),separators=(',',':'))
Report='16 | EXISTING SEQUENCE -> ORTHOTROPIC RIBBON FE\n%d panels; %d original segments; %d shell triangles; %d unique frame beams.\nOnly original boundary endpoints share node IDs. Crossings remain unbonded.\nFour fixed ground corners ASSUMED; total lateral +X %.3f kN on %d roof vertices.\nRibbon %.3fmm x %.9fmm; Ns%d/Nw%d; max Lcell/Wcell %.3f.\nNo gravity; no added winding/reinforcement. Convergence and construction safety UNVERIFIED.'%(len(poly),count,count*2*ns*nw,len(edges),force,len(roof),width*1000,thickness*1000,ns,nw,maxaspect)
# ---------- end sequence_cfrp_owned_ribbons ----------
panel_2 = Panel(sequence_cfrp_owned_ribbons.Report)  # disabled
metric_boundary_b = Curve(sequence_cfrp_owned_ribbons.MetricB)  # disabled
metric_boundary_a = Curve(sequence_cfrp_owned_ribbons.MetricA)  # disabled
# NG01 PREFLIGHT / ANALYZE HELD: NATIVE KARAMBA BUILD / NO ANALYZE YET
# 55 panels; 25,520 shell triangles; 28,824 nodes.
# 9,584 beams: owner CFRP edges + local Al sleeve surrogates.
# 60 XYZ supports along 7 ground boundary edges.
# Cases: G, G+X, G-X, G+Y, G-Y (lateral 1 kN).
# InitialStrain OFF. No bolt/contact stress claim.
# HOLD: lower boundary reaches Z=-0.056367569 m.
# P001, P007, P052 have anchors below ground.
# Red points are geometry observations, not stress colors.
# Await ground-boundary decision before Analyze.
o_section_3 = CrossSectionsBeamKaramba3D(
    FamilyNameOfCrossSection="CFRP REFERENCE",
    NameOfCrossSection="BOUNDARY",
    Material=orthotropic,
    Diameter_cm=1,
    WallThickness_cm=0.5,
    mode="Circular Hollow")  # -> CrossSection, CentreOfGravity; disabled
shell_const_3 = CrossSectionsShellKaramba3D(
    FamilyNameOfCrossSection="SPATIAL UD RIBBON",
    NameOfCrossSection=sequence_cfrp_owned_ribbons.Names,
    Material=orthotropic,
    Height_cm=sequence_cfrp_owned_ribbons.Height,
    mode="Shell - Const")  # -> CrossSection, CentreOfGravity; disabled
linetobeam_3 = CreateLinearElementKaramba3D(
    Line=sequence_cfrp_owned_ribbons.FrameLines,
    Identifier="BOUNDARY",
    CrossSection=o_section_3.CrossSection,
    LimitDistance_m=1e-06,
    BucklingLengthY_m=-1,
    BucklingLengthZ_m=-1,
    BucklingLengthLT_m=-1,
    Bending=True,
    ToPolylineMaxAngle=0.25,
    ToPolylineTolerance=0.1,
    ToPolylineMaxEdgeLength=0.25,
    New=True,
    Remove=True,
    mode="LineToBeam",
    GuidGeneratorSeed=-1905890255)  # -> Element, Points, Info; disabled
mesh_to_shell_3 = MeshToShellKaramba3D(
    Mesh=sequence_cfrp_owned_ribbons.Meshes,
    Identifier=sequence_cfrp_owned_ribbons.Names,
    CrossSection=shell_const_3.CrossSection,
    Points=sequence_cfrp_owned_ribbons.ExactPts,
    LimitDistance_m=1e-07,
    Bending=True,
    GuidGeneratorSeed=-315674144)  # -> Element, Points, Info; disabled
supp_5 = SupportKaramba3D(
    PosInd=sequence_cfrp_owned_ribbons.SupportP,
    Ct_kN_m=Vector(0, 0, 0),
    Cr_kNm_rad=Vector(0, 0, 0),
    Dofs=[0, 1, 2, 3, 4, 5],
    menu=[buttons(off, off, off, off, off, off)])  # disabled
pointload_7 = LoadsKaramba3D(
    ForceVector=sequence_cfrp_owned_ribbons.LoadV,
    Local=False,
    PosInd=sequence_cfrp_owned_ribbons.LoadP,
    LCase="LATERAL_X_REF",
    mode="Point")  # disabled
shell_3 = OrientateElemKaramba3D(Shell=mesh_to_shell_3.Element, XOrientations=sequence_cfrp_owned_ribbons.Axes, mode="Shell")  # disabled
assemble_2 = AssembleModelKaramba3D(
    Elem=flatten([shell_3, linetobeam_3.Element]),
    Support=flatten(supp_5),
    Load=flatten(pointload_7),
    LimitDistance_m=1e-06,
    Points=flatten(sequence_cfrp_owned_ribbons.FramePts))  # -> Model, Info, Mass_kg, CentreOfGravity, LoadCaseNames; disabled
owned_shell_assembly_explicit_indices = GhPythonScript(
    Model=assemble_2.Model,
    Meshes=sequence_cfrp_owned_ribbons.Meshes,
    IndexMap=sequence_cfrp_owned_ribbons.IndexMap,
    Meta=sequence_cfrp_owned_ribbons.Meta,
    RibbonBuilders=shell_3,
    AllPoints=sequence_cfrp_owned_ribbons.AssemblyPts)  # -> OwnedModel, Report, NativeMass; inputs Meshes: tree, IndexMap: tree, RibbonBuilders: tree, AllPoints: tree; disabled
# ---------- owned_shell_assembly_explicit_indices: Python ----------
import clr,System,json,math
clr.AddReference('KarambaCommon')
from System.Collections.Generic import List
from Karamba.Geometry import Mesh3,Point3
from Karamba.Elements import ModelShell,BuilderShell
from Karamba.Nodes import Node
from Grasshopper import DataTree
from Grasshopper.Kernel.Data import GH_Path
def val(v):return v.Value if hasattr(v,'Value') else v
meta=json.loads(str(val(Meta)))
expected=int(meta['explicit_master_nodes']);frame_count=int(meta['frame_seed_nodes'])
m=val(Model).Clone();m.cloneElements();m.cloneNodes();m.cloneMaterialList();m.cloneCrossSectionList()
points=[val(v) for v in AllPoints.AllData()]
if len(points)!=expected or len(m.nodes)<frame_count:raise ValueError('Explicit master/frame node counts differ.')
original_shells={e.id:e for e in m.elems if e.GetType().Name=='ModelShell'}
if len(original_shells)!=len(meta['records']):raise ValueError('Native shell ID registration is incomplete.')
m.nodes.RemoveRange(frame_count,len(m.nodes)-frame_count)
coordinate_error=0.
for i,p in enumerate(points):
 if i<frame_count:
  q=m.nodes[i].pos;error=math.sqrt((p.X-q.X)**2+(p.Y-q.Y)**2+(p.Z-q.Z)**2)
  coordinate_error=max(coordinate_error,error)
  if error>1e-10:raise ValueError('Native frame assembly changed original master ordering.')
 else:
  added=m.add(Node(i,Point3(p.X,p.Y,p.Z)))
  if added!=i or m.nodes[i].ind!=i:raise ValueError('Private ribbon node index changed.')
original_beams=[(e.ind,list(e.node_inds)) for e in m.elems if e.GetType().Name=='ModelBeam']
if any(i>=frame_count for _,indices in original_beams for i in indices):raise ValueError('Boundary beam attached to a private ribbon node.')
builders={val(v).id:val(v) for v in RibbonBuilders.AllData()};count=0
for rec in meta['records']:
 original=builders.get(rec['name'])
 if original is None:raise ValueError('Missing native oriented ribbon builder.')
 path=next(p for p in Meshes.Paths if list(p.Indices)==[rec['panel'],rec['family']])
 patch=val(list(Meshes.Branch(path))[0]);indices=List[System.Int32]([int(val(v)) for v in IndexMap.Branch(path)])
 if len(indices)!=patch.Vertices.Count:raise ValueError('Owned index tree differs from exact ribbon mesh.')
 km=Mesh3()
 for vi,index in enumerate(indices):
  p=patch.Vertices.Point3dAt(vi);q=m.nodes[index].pos
  error=math.sqrt((p.X-q.X)**2+(p.Y-q.Y)**2+(p.Z-q.Z)**2);coordinate_error=max(coordinate_error,error)
  if error>1e-10:raise ValueError('Private node moved from original ribbon geometry.')
  km.AddVertex(Point3(p.X,p.Y,p.Z))
 for face in patch.Faces:
  if not face.IsTriangle:raise ValueError('Only triangular ribbon faces supported.')
  km.AddFace(face.A,face.B,face.C)
 km.ComputeNormals();builder=BuilderShell(original.guid,km)
 for prop in original.GetType().GetProperties():
  if prop.CanRead and prop.CanWrite and prop.Name not in ['Pos','guid']:prop.SetValue(builder,prop.GetValue(original,None),None)
 builder.id=rec['name'];builder.crosec=original.crosec
 old=original_shells[rec['name']]
 m.elems[old.ind]=ModelShell(old.ind,builder,old.crosec,indices,m.nodes);count+=1
if count!=len(meta['records']):raise ValueError('Missing panel/family shell.')
m.initMaterialCroSecLists();m.initShellMeshes();m.CreateNodeKdTree();m.buildFEModel()
triangles=0
for e in m.elems:
 if e.GetType().Name!='ModelShell':continue
 for fi,face in enumerate(e.mesh.Faces):
  actual=m.febmodel.element(e.fe_ind_begin+fi)
  wanted=[e.node_inds[k] for k in [face.A,face.B,face.C]]
  if [actual.node(j).ind() for j in range(actual.nNodes())]!=wanted:raise ValueError('Actual FE connectivity differs from owned indices.')
  triangles+=1
if triangles!=meta['triangles']:raise ValueError('Actual FE triangle count changed.')
if [(e.ind,list(e.node_inds)) for e in m.elems if e.GetType().Name=='ModelBeam']!=original_beams:raise ValueError('Boundary beam connectivity changed.')
types=[]
for a in System.AppDomain.CurrentDomain.GetAssemblies():
 if 'karamba' in a.GetName().Name.lower():types.extend(t for t in a.GetTypes() if t.Name=='GH_Model')
if len(types)!=1:raise ValueError('Native GH model type not unique.')
OwnedModel=DataTree[object]()
OwnedModel.Add(System.Activator.CreateInstance(types[0],System.Array[System.Object]([m])),GH_Path(0))
NativeMass=m.mass()*1000
Report='16b | EXPLICIT OWNED SHELL ASSEMBLY\nNative seed model retains shell IDs, materials and orientations.\nAll private ribbon nodes rebuilt before analysis; seed coordinate bonds discarded.\n%d nodes; %d actual FE triangles verified; coordinate error %.3g m.\nOnly center/frame endpoints share IDs. Coincident crossings remain independent.\nLDist1e-6m and boundary connectivity unchanged; no geometry jitter.'%(expected,triangles,coordinate_error)
# ---------- end owned_shell_assembly_explicit_indices ----------
panel_3 = Panel(owned_shell_assembly_explicit_indices.Report)  # disabled
analyse_2 = AnalyseKaramba3D(Model=owned_shell_assembly_explicit_indices.OwnedModel, LoadCases=license_2)  # -> AnalysedModel, MaximumDisplacement_cm, ResultingForce_kN, ChangeOfElasticEnergy_kNm; disabled

# ---- group: PANJANG + BERAT WINDING PER PANEL | m / kg
# BASIS BERAT | METER | TANPA FE: Satuan meter, dikonfirmasi pengguna dan Rhino. Penampang + densitas membaca input GH yang sudah ada.
# Massa = panjang garis berurutan x (lebar mm x tebal mm / 1e6) x rho. Tidak menghapus garis berulang.
# Hanya winding CFRP: tidak termasuk boundary, aluminium, baut, waste atau kontak baut yang tidak dimodelkan.
# Pilih Panel Metrik: 1..jumlah panel aktual. FE tetap dijeda; geometri, winding dan toleransi tidak diubah.
luas_penampang_winding_m2 = Expression(x=ribbon_width_mm_assumed, y=ribbon_thickness_mm_equivalent, Expression="x*y/1000000")
panjang_setiap_garis_m = Length(Curve=ln_3)
pilih_panel_metrik = Slider(1, range=1..100)
massa_per_meter_winding_kg_m = Expression(x=luas_penampang_winding_m2, y=composite_density_kg_m3, Expression="x*y")
panjang_winding_per_panel_m = MassAddition(Input=panjang_setiap_garis_m)  # -> Result, PartialResults
g_m_s2 = Panel("9.80665")
total_winding_m = MassAddition(Input=flatten(panjang_winding_per_panel_m.Result))  # -> Result, PartialResults
berat_winding_per_panel_kg = Expression(x=panjang_winding_per_panel_m.Result, y=massa_per_meter_winding_kg_m, Expression="x*y")
laporan_panjang_dan_berat_per_panel = GhPythonScript(Lengths=panjang_winding_per_panel_m.Result, Masses=berat_winding_per_panel_kg, PanelIndex=pilih_panel_metrik)  # -> out, Table, Selected; inputs Lengths: tree, Masses: tree, PanelIndex: tree
# ---------- laporan_panjang_dan_berat_per_panel: Python ----------
# Numeric formatting only. Geometry and native length/mass arithmetic are upstream.
def number(v):return float(v.ScriptVariable() if hasattr(v,'ScriptVariable') else v)
lp=ghenv.Component.Params.Input[0].VolatileData;mp=ghenv.Component.Params.Input[1].VolatileData
assert list(map(str,lp.Paths))==list(map(str,mp.Paths)), 'Panel mapping length/mass mismatch'
rows=[]
for i,path in enumerate(lp.Paths):
    l=lp.get_Branch(path);m=mp.get_Branch(path);assert len(l)==len(m)==1
    rows.append(('P%03d'%(i+1),number(l[0]),number(m[0])))
Table='PANEL | PANJANG WINDING (m) | BERAT WINDING (kg)\n'+'\n'.join('%s | %.3f m | %.4f kg'%row for row in rows)
Table+='\nTOTAL | %.3f m | %.4f kg'%(sum(r[1] for r in rows),sum(r[2] for r in rows))
raw=list(ghenv.Component.Params.Input[2].VolatileData.AllData(True));index=int(number(raw[0])) if raw else 1
Selected=('%s\nPanjang winding: %.3f m\nBerat winding CFRP: %.4f kg'%rows[index-1]) if 1<=index<=len(rows) else 'Pilih panel 1 sampai %d; panel %d tidak tersedia.'%(len(rows),index)
print('Estimasi winding CFRP saja. 20 mm x 0.981747704 mm; rho 1620 kg/m3. Nilai sumber dapat dibaca dari panel input. Boundary, sleeve, baut, waste dan lilitan kontak yang tidak dimodelkan dikecualikan. Bukan massa FE.')
# ---------- end laporan_panjang_dan_berat_per_panel ----------
total_berat_winding_kg = MassAddition(Input=flatten(berat_winding_per_panel_kg))  # -> Result, PartialResults
gaya_berat_winding_per_panel_n = Expression(x=berat_winding_per_panel_kg, y=g_m_s2, Expression="x*y")
total_gaya_berat_n = MassAddition(Input=flatten(gaya_berat_winding_per_panel_n))  # -> Result, PartialResults
total_winding_m_2 = Panel(total_winding_m.Result)
total_berat_winding_kg_2 = Panel(total_berat_winding_kg.Result)
total_gaya_berat_n_2 = Panel(total_gaya_berat_n.Result)
panel_terpilih_winding_saja = Panel(laporan_panjang_dan_berat_per_panel.Selected)
tabel_panjang_dan_berat_setiap_panel = Panel(laporan_panjang_dan_berat_per_panel.Table)

# ----
pointload_8 = LoadsKaramba3D(
    ForceVector=Vector(0.007299270073, 0, 0),
    Local=False,
    PosInd=ng01_geometri_fe_native_c.LoadP,
    LCase="G_X_POS",
    mode="Point")
pointload_9 = LoadsKaramba3D(
    ForceVector=Vector(-0.007299270073, 0, 0),
    Local=False,
    PosInd=ng01_geometri_fe_native_c.LoadP,
    LCase="G_X_NEG",
    mode="Point")
pointload_10 = LoadsKaramba3D(
    ForceVector=Vector(0, 0.007299270073, 0),
    Local=False,
    PosInd=ng01_geometri_fe_native_c.LoadP,
    LCase="G_Y_POS",
    mode="Point")
pointload_11 = LoadsKaramba3D(
    ForceVector=Vector(0, -0.007299270073, 0),
    Local=False,
    PosInd=ng01_geometri_fe_native_c.LoadP,
    LCase="G_Y_NEG",
    mode="Point")
pointload_12 = LoadsKaramba3D(
    ForceVector=Vector(0.007299270073, 0, 0),
    Local=False,
    PosInd=ng01_geometri_fe_native_c.LoadP,
    LCase="L_X_POS",
    mode="Point")
pointload_13 = LoadsKaramba3D(
    ForceVector=Vector(-0.007299270073, 0, 0),
    Local=False,
    PosInd=ng01_geometri_fe_native_c.LoadP,
    LCase="L_X_NEG",
    mode="Point")
pointload_14 = LoadsKaramba3D(
    ForceVector=Vector(0, 0.007299270073, 0),
    Local=False,
    PosInd=ng01_geometri_fe_native_c.LoadP,
    LCase="L_Y_POS",
    mode="Point")
pointload_15 = LoadsKaramba3D(
    ForceVector=Vector(0, -0.007299270073, 0),
    Local=False,
    PosInd=ng01_geometri_fe_native_c.LoadP,
    LCase="L_Y_NEG",
    mode="Point")
assemble_3 = AssembleModelKaramba3D(
    Elem=flatten([shell_2, linetobeam.Element, linetobeam_2.Element]),
    Support=flatten(supp_4),
    Load=flatten([gravity, pointload_2, gravity_2, pointload_3, pointload_8, gravity_3, pointload_4, pointload_9, gravity_4, pointload_5, pointload_10, gravity_5, pointload_6, pointload_11, pointload_12, pointload_13, pointload_14, pointload_15]),
    LimitDistance_m=1e-08,
    Points=flatten(ng01_frozen_native_c_frame_points))  # -> Model, Info, Mass_kg, CentreOfGravity, LoadCaseNames
ng01_native_owned_shell_connectivity_ada = GhPythonScript(
    Model=assemble_3.Model,
    Meshes=ng01_geometri_fe_native_c.Meshes,
    IndexMap=ng01_geometri_fe_native_c.IndexMap,
    Meta=ng01_geometri_fe_native_c.Meta,
    RibbonBuilders=shell_2,
    AllPoints=ng01_geometri_fe_native_c.AssemblyPts)  # -> OwnedModel, Report, NativeMass; "NG01 native owned shell connectivity adapter"; inputs Meshes: tree, IndexMap: tree, RibbonBuilders: tree, AllPoints: tree
# ---------- ng01_native_owned_shell_connectivity_ada: Python ----------
import clr,System,json,math
clr.AddReference('KarambaCommon')
from System.Collections.Generic import List
from Karamba.Geometry import Mesh3,Point3
from Karamba.Elements import ModelShell,BuilderShell
from Karamba.Nodes import Node
from Grasshopper import DataTree
from Grasshopper.Kernel.Data import GH_Path
def val(v):return v.Value if hasattr(v,'Value') else v
meta=json.loads(str(val(Meta)))
expected=int(meta['explicit_master_nodes']);frame_count=int(meta['frame_seed_nodes'])
m=val(Model).Clone();m.cloneElements();m.cloneNodes();m.cloneMaterialList();m.cloneCrossSectionList()
points=[val(v) for v in AllPoints.AllData()]
if len(points)!=expected or len(m.nodes)<frame_count:raise ValueError('Explicit master/frame node counts differ.')
original_shells={e.id:e for e in m.elems if e.GetType().Name=='ModelShell'}
if len(original_shells)!=len(meta['records']):raise ValueError('Native shell ID registration is incomplete.')
m.nodes.RemoveRange(frame_count,len(m.nodes)-frame_count)
coordinate_error=0.
for i,p in enumerate(points):
 if i<frame_count:
  q=m.nodes[i].pos;error=math.sqrt((p.X-q.X)**2+(p.Y-q.Y)**2+(p.Z-q.Z)**2)
  coordinate_error=max(coordinate_error,error)
  if error>1e-10:raise ValueError('Native frame assembly changed original master ordering.')
 else:
  added=m.add(Node(i,Point3(p.X,p.Y,p.Z)))
  if added!=i or m.nodes[i].ind!=i:raise ValueError('Private ribbon node index changed.')
original_beams=[(e.ind,list(e.node_inds)) for e in m.elems if e.GetType().Name=='ModelBeam']
if any(i>=frame_count for _,indices in original_beams for i in indices):raise ValueError('Boundary beam attached to a private ribbon node.')
builders={val(v).id:val(v) for v in RibbonBuilders.AllData()};count=0
for rec in meta['records']:
 original=builders.get(rec['name'])
 if original is None:raise ValueError('Missing native oriented ribbon builder.')
 path=next(p for p in Meshes.Paths if list(p.Indices)==[rec['panel'],rec['family']])
 patch=val(list(Meshes.Branch(path))[0]);indices=List[System.Int32]([int(val(v)) for v in IndexMap.Branch(path)])
 if len(indices)!=patch.Vertices.Count:raise ValueError('Owned index tree differs from exact ribbon mesh.')
 km=Mesh3()
 for vi,index in enumerate(indices):
  p=patch.Vertices.Point3dAt(vi);q=m.nodes[index].pos
  error=math.sqrt((p.X-q.X)**2+(p.Y-q.Y)**2+(p.Z-q.Z)**2);coordinate_error=max(coordinate_error,error)
  if error>1e-10:raise ValueError('Private node moved from original ribbon geometry.')
  km.AddVertex(Point3(p.X,p.Y,p.Z))
 for face in patch.Faces:
  if not face.IsTriangle:raise ValueError('Only triangular ribbon faces supported.')
  km.AddFace(face.A,face.B,face.C)
 km.ComputeNormals();builder=BuilderShell(original.guid,km)
 for prop in original.GetType().GetProperties():
  if prop.CanRead and prop.CanWrite and prop.Name not in ['Pos','guid']:prop.SetValue(builder,prop.GetValue(original,None),None)
 builder.id=rec['name'];builder.crosec=original.crosec
 old=original_shells[rec['name']]
 m.elems[old.ind]=ModelShell(old.ind,builder,old.crosec,indices,m.nodes);count+=1
if count!=len(meta['records']):raise ValueError('Missing panel/family shell.')

# Additional full-turn dead loads at native bonded nodes; no new support.
from Karamba.Loads import PointLoad
from Karamba.Geometry import Vector3
m.ploads=List[PointLoad](m.ploads)
turn_force=2*math.pi*.0065*.02*.000981747704*15.886773
for case in ['G','G_X_POS','G_X_NEG','G_Y_POS','G_Y_NEG']:
 for index in meta.get('reinforcement_turn_nodes',[]):m.ploads.Add(PointLoad(int(index),Vector3(0,0,-turn_force),Vector3(0,0,0),case,False))

m.initMaterialCroSecLists();m.initShellMeshes();m.CreateNodeKdTree();m.buildFEModel()
triangles=0
for e in m.elems:
 if e.GetType().Name!='ModelShell':continue
 for fi,face in enumerate(e.mesh.Faces):
  actual=m.febmodel.element(e.fe_ind_begin+fi)
  wanted=[e.node_inds[k] for k in [face.A,face.B,face.C]]
  if [actual.node(j).ind() for j in range(actual.nNodes())]!=wanted:raise ValueError('Actual FE connectivity differs from owned indices.')
  triangles+=1
if triangles!=meta['triangles']:raise ValueError('Actual FE triangle count changed.')
if [(e.ind,list(e.node_inds)) for e in m.elems if e.GetType().Name=='ModelBeam']!=original_beams:raise ValueError('Boundary beam connectivity changed.')
types=[]
for a in System.AppDomain.CurrentDomain.GetAssemblies():
 if 'karamba' in a.GetName().Name.lower():types.extend(t for t in a.GetTypes() if t.Name=='GH_Model')
if len(types)!=1:raise ValueError('Native GH model type not unique.')
OwnedModel=DataTree[object]()
OwnedModel.Add(System.Activator.CreateInstance(types[0],System.Array[System.Object]([m])),GH_Path(0))
NativeMass=m.mass()*1000
Report='16b | EXPLICIT OWNED SHELL ASSEMBLY\nNative seed model retains shell IDs, materials and orientations.\nAll private ribbon nodes rebuilt before analysis; seed coordinate bonds discarded.\n%d nodes; %d actual FE triangles verified; coordinate error %.3g m.\nOnly center/frame endpoints share IDs. Coincident crossings remain independent.\nLDist1e-6m and boundary connectivity unchanged; no geometry jitter.'%(expected,triangles,coordinate_error)
# ---------- end ng01_native_owned_shell_connectivity_ada ----------
analyse_3 = AnalyseKaramba3D(Model=ng01_native_owned_shell_connectivity_ada.OwnedModel)  # -> AnalysedModel, MaximumDisplacement_cm, ResultingForce_kN, ChangeOfElasticEnergy_kNm; disabled
ng01_mesh_preview_no_fe_result = CustomPreview(
    Geometry=ng01_geometri_fe_native_c.Meshes,
    Material=[{diffuse=RGB(221, 160, 221), emission=RGB(66, 48, 66), shine=0.5, specular=RGB(255, 255, 255), transparency=0}, {diffuse=RGB(70, 90, 78), emission=RGB(0, 0, 0), shine=0, specular=RGB(255, 255, 255), transparency=0}])
ng01_cfrp_equivalent_owner_edges = CustomPreview(
    Geometry=ng01_geometri_fe_native_c.FrameLines,
    Material=[{diffuse=RGB(221, 160, 221), emission=RGB(66, 48, 66), shine=0.5, specular=RGB(255, 255, 255), transparency=0}, {diffuse=RGB(140, 160, 150), emission=RGB(0, 0, 0), shine=0, specular=RGB(255, 255, 255), transparency=0}])
modelview = ModelViewKaramba3D(Model=analyse_2.AnalysedModel)  # -> Model, DeformedMesh, DeformedAxes, DeformedModel, MaximumDeformation; disabled
beamview = BeamViewKaramba3D(Model=modelview.Model)  # -> Model, MeshesOfRenderedBeams, DeformedBeamAxes, LegendColours, LegendTags; disabled
shellview = ShellViewKaramba3D(Model=modelview.Model, IndexOfLayer=0)  # -> Model, MeshesOfRenderedShells, LegendColours, LegendTags; disabled
legend = LegendKaramba3D(
    Colors=shellview.LegendColours,
    Tags=shellview.LegendTags,
    Scale=0.8,
    Textsize=30,
    Legend_HasHeader=False,
    Legend_Justification=2,
    Legend_Position=2)  # disabled

# ---- group: 17 | STRESS - raw peaks, Tsai-Wu, equilibrium and displacement
react_2 = ReactionForcesKaramba3D(AnalysedModel=analyse_2.AnalysedModel, LoadCase="LATERAL_X_REF")  # -> Model, ReactionForces_kN, ReactionMoments_kNm, SupportPosition, SumOfReactionForces_kN, SumOfReactionMoments_kNm, GoverningLoadCaseIndex; disabled
b_forces = BeamForcesKaramba3D(AnalysedModel=analyse_2.AnalysedModel, LoadCase="LATERAL_X_REF", Ts=[0, 1])  # -> Model, NormalForce_kN, ShearForceVz_kN, ShearForceVy_kN, TorsionalMomentMt_kNm, BendingMomentMy_kNm, BendingMomentMz_kNm, LoadCaseIndex; disabled
nodedisp_2 = NodalDisplacementsKaramba3D(AnalysedModel=analyse_2.AnalysedModel, LoadCaseCombination="LATERAL_X_REF")  # -> Model, NodalTranslations_m, NodalRotations_rad, DisplacementPosition, LoadCaseIndex; disabled
local = ShellForcesKaramba3D(AnalysedModel=analyse_2.AnalysedModel, LoadCase="LATERAL_X_REF", mode="Local")  # -> Model, Nxx_kN_m, Nyy_kN_m, Nxy_kN_m, Mxx_kNm_m, Myy_kNm_m, Mxy_kNm_m, Vx_kN_m, Vy_kN_m, LoadCaseIndex; disabled
raw_stresses_and_mechanical_checks = GhPythonScript(
    Model=analyse_2.AnalysedModel,
    Meta=sequence_cfrp_owned_ribbons.Meta,
    Nx=local.Nxx_kN_m,
    Ny=local.Nyy_kN_m,
    Nxy=local.Nxy_kN_m,
    Mx=local.Mxx_kNm_m,
    My=local.Myy_kNm_m,
    Mxy=local.Mxy_kNm_m,
    BN=b_forces.NormalForce_kN,
    BVy=b_forces.ShearForceVy_kN,
    BVz=b_forces.ShearForceVz_kN,
    BT=b_forces.TorsionalMomentMt_kNm,
    BMy=b_forces.BendingMomentMy_kNm,
    BMz=b_forces.BendingMomentMz_kNm,
    Trans=nodedisp_2.NodalTranslations_m,
    RF=react_2.ReactionForces_kN,
    RM=react_2.ReactionMoments_kNm,
    Energy=analyse_2.ChangeOfElasticEnergy_kNm,
    NativeMass=owned_shell_assembly_explicit_indices.NativeMass,
    SF=material_screening_safety_factor,
    Material=orthotropic,
    MaxDisp=analyse_2.MaximumDisplacement_cm,
    CouponPassed=coupon_e1_e2_validation.Passed,
    ReactionPos=react_2.SupportPosition)  # -> Sigma11, Sigma22, Tau12, Ratio, TsaiWu, PeakNormal, PeakShear, PeakRatio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; inputs Nx: tree, Ny: tree, Nxy: tree, Mx: tree, My: tree, Mxy: tree, BN: tree, BVy: tree, BVz: tree, BT: tree, BMy: tree, BMz: tree, Trans: tree, RF: tree, RM: tree, ReactionPos: tree; disabled
# ---------- raw_stresses_and_mechanical_checks: Python ----------
import math,json,re,hashlib,Rhino.Geometry as rg
from Grasshopper import DataTree
from Grasshopper.Kernel.Data import GH_Path
exec('# -*- coding: ascii -*-\n"""Pure shell-stress helpers, compatible with IronPython 2.7.\n\nInputs are material-local shell resultants, not principal resultants.\nThickness is in metres; stresses/strengths are in MPa.\nThis is an elastic section screening, not a construction safety verdict.\n"""\nimport math\n\n\ndef _finite(value, name):\n    value = float(value)\n    if math.isnan(value) or math.isinf(value):\n        raise ValueError(name + " must be finite.")\n    return value\n\n\ndef _positive(value, name):\n    value = _finite(value, name)\n    if value <= 0.0:\n        raise ValueError(name + " must be positive.")\n    return value\n\n\ndef stress_top_bottom(Nxx, Nyy, Nxy, Mxx, Myy, Mxy, t_m):\n    """Return (top, bottom), each (sigma11, sigma22, tau12) in MPa.\n\n    Nxx/Nyy/Nxy: kN/m. Mxx/Myy/Mxy: kNm/m. t_m: m.\n    Karamba local shell convention: positive moment gives tension on the\n    upper face (+local Z). Thus top = N/t + 6 M/t**2; bottom uses minus.\n    Nxy/Mxy are physical tensor shear resultants: there is NO factor of\n    two in stress recovery. Engineering shear is gamma12 = 2 epsilon12.\n    Reversing all moment signs swaps top/bottom and leaves their maximum\n    stress/failure envelope invariant. No smoothing or clipping is used.\n    """\n    t = _positive(t_m, "Shell thickness")\n    ns = [_finite(Nxx, "Nxx"), _finite(Nyy, "Nyy"),\n          _finite(Nxy, "Nxy")]\n    ms = [_finite(Mxx, "Mxx"), _finite(Myy, "Myy"),\n          _finite(Mxy, "Mxy")]\n    # kN/m2 -> MPa: divide by 1000.\n    top = tuple((n / t + 6.0 * m / (t * t)) / 1000.0\n                for n, m in zip(ns, ms))\n    bottom = tuple((n / t - 6.0 * m / (t * t)) / 1000.0\n                   for n, m in zip(ns, ms))\n    return top, bottom\n\n\ndef maximumStress(sigma11, sigma22, tau12, Xt, Xc, Yt, Yc, S12,\n                  SF=1.0):\n    """Return maximum-stress utilization, using positive MPa strengths.\n\n    Tension and compression use their corresponding signed stress.\n    SF multiplies the stresses; a utilization <= 1 meets this material\n    screening only. It does not include buckling, bond or delamination.\n    """\n    s1 = _finite(sigma11, "sigma11")\n    s2 = _finite(sigma22, "sigma22")\n    shear = _finite(tau12, "tau12")\n    xt = _positive(Xt, "Xt")\n    xc = _positive(Xc, "Xc")\n    yt = _positive(Yt, "Yt")\n    yc = _positive(Yc, "Yc")\n    strength_shear = _positive(S12, "S12")\n    sf = _positive(SF, "SF")\n    r1 = s1 / xt if s1 >= 0.0 else -s1 / xc\n    r2 = s2 / yt if s2 >= 0.0 else -s2 / yc\n    return sf * max(r1, r2, abs(shear) / strength_shear)\n\n\ndef tsai_wu_coefficients(Xt, Xc, Yt, Yc, S12, f12=-0.5):\n    """Return F1,F2,F11,F22,F66,F12 for MPa inputs.\n\n    f12 is the DIMENSIONLESS normalized interaction coefficient:\n    F12 = f12 * sqrt(F11*F22). The equation includes 2*F12*s1*s2.\n    f12=-0.5 is an explicit assumption absent a biaxial coupon test.\n    |f12| <= 1 keeps the normal-stress quadratic form nonnegative.\n    """\n    xt = _positive(Xt, "Xt")\n    xc = _positive(Xc, "Xc")\n    yt = _positive(Yt, "Yt")\n    yc = _positive(Yc, "Yc")\n    shear = _positive(S12, "S12")\n    interaction = _finite(f12, "f12")\n    if abs(interaction) > 1.0:\n        raise ValueError("Dimensionless f12 must lie between -1 and 1.")\n    f1 = 1.0 / xt - 1.0 / xc\n    f2 = 1.0 / yt - 1.0 / yc\n    f11 = 1.0 / (xt * xc)\n    f22 = 1.0 / (yt * yc)\n    f66 = 1.0 / (shear * shear)\n    f12_dimensional = interaction * math.sqrt(f11 * f22)\n    return f1, f2, f11, f22, f66, f12_dimensional\n\n\ndef fullplaneStressTsaiWu(sigma11, sigma22, tau12, Xt, Xc, Yt, Yc,\n                         S12, SF=1.0, f12=-0.5):\n    """Return full plane-stress Tsai-Wu failure index (dimensionless).\n\n    Inputs sigma11,sigma22,tau12 must be in material-local axes in MPa.\n    All three stresses are multiplied by SF before evaluation. Preserve\n    the actual signed index; it can be negative inside the failure locus.\n    FI <= 1 is only this assumed material criterion, not structural safety.\n    """\n    sf = _positive(SF, "SF")\n    s1 = sf * _finite(sigma11, "sigma11")\n    s2 = sf * _finite(sigma22, "sigma22")\n    shear = sf * _finite(tau12, "tau12")\n    f1, f2, f11, f22, f66, f12_dimensional = tsai_wu_coefficients(\n        Xt, Xc, Yt, Yc, S12, f12)\n    return (f1 * s1 + f2 * s2 + f11 * s1 * s1 + f22 * s2 * s2\n            + 2.0 * f12_dimensional * s1 * s2 + f66 * shear * shear)\n\n\n# Snake-case aliases for callers that prefer the usual Python convention.\nmaximum_stress = maximumStress\nfull_plane_stress_tsai_wu = fullplaneStressTsaiWu\n')
def stress_failure_indices(s1,s2,tau,xt,xc,yt,yc,shear,sf,f12):
 return maximumStress(s1,s2,tau,xt,xc,yt,yc,shear,sf),fullplaneStressTsaiWu(s1,s2,tau,xt,xc,yt,yc,shear,sf,f12)
def val(v):return v.Value if hasattr(v,'Value') else v
def values(tree):return [val(v) for v in tree.AllData()]
def vector(v):return rg.Vector3d(v.X,v.Y,v.Z)
def material_values(m):return [m.E(0),m.E(1),m.G12(),m.G3(0),m.G3(1),m.nue12(),m.gamma(),m.ft(0),m.ft(1),m.fc(0),m.fc(1),m.t12(),m.f12()]
model=val(Model);meta=json.loads(str(val(Meta)));sf=float(val(SF));mat=val(Material);energy=float(val(Energy));native_mass=float(val(NativeMass));disp_cm=float(val(MaxDisp));coupon=bool(val(CouponPassed))
if model.gravities.Count or len(model.eloads) or len(model.mloads):raise ValueError('Energy check supports reference point loads only.')
if not model.displacementsReady() or not model.forcesReady():raise ValueError('Analysed spatial model is required.')
elements=list(model.Elements());shells=[e for e in elements if e.GetType().Name=='ModelShell'];beams=[e for e in elements if e.GetType().Name=='ModelBeam'];nodes=model.nodes
framenodes=set(i for e in beams for i in e.node_inds);owners={};endpoint_error=0;endpoint_count=0;coordinate_error=0
records={r['name']:r for r in meta['records']};maps=[]
for tree in [Nx,Ny,Nxy,Mx,My,Mxy]:
 d={}
 for path in tree.Paths:
  vs=list(tree.Branch(path))
  if not vs:continue
  if len(path.Indices)!=3 or path.Indices[0]!=0 or len(vs)!=1:raise ValueError('Unexpected shell result/load-case tree; refusing implicit flattening.')
  d[(int(path.Indices[1]),int(path.Indices[2]))]=float(val(vs[0]))
 maps.append(d)
bm=[]
for tree in [BN,BVy,BVz,BT,BMy,BMz]:
 d={}
 for path in tree.Paths:
  if not list(tree.Branch(path)):continue # Native extractor includes empty paths for shell elements; no numeric force is removed.
  if len(path.Indices)!=2 or path.Indices[0]!=0:raise ValueError('Unexpected boundary force tree.')
  d[int(path.Indices[1])]=[float(val(v)) for v in tree.Branch(path)]
 bm.append(d)
parent=list(range(len(nodes)))
def root(i):
 while parent[i]!=i:parent[i]=parent[parent[i]];i=parent[i]
 return i
def join(a,b):
 a,b=root(a),root(b)
 if a!=b:parent[b]=a
Sigma11=DataTree[object]();Sigma22=DataTree[object]();Tau12=DataTree[object]();Ratio=DataTree[object]();TsaiWu=DataTree[object]();hot=[];samples=0;axiserr=0;tangenterr=0;maxnormal=0;maxshear=0;maxratio=0;maxtw=-1e100;peak=None;volume=0;shellvol=0;materialsok=True
def take(row):
 global maxnormal,maxshear,maxratio,maxtw,peak
 maxnormal=max(maxnormal,row['normal_MPa']);maxshear=max(maxshear,row['shear_MPa']);maxratio=max(maxratio,row['ratio']);maxtw=max(maxtw,row['TsaiWu'])
 if peak is None or row['normal_MPa']>peak['normal_MPa']:peak=row
 hot.append(row)
for e in shells:
 if e.id not in records:raise ValueError('Unexpected shell identifier.')
 rec=records[e.id];h=float(e.crosec.getHeight());material=e.crosec.material;vol=float(e.Volume(nodes));volume+=vol;shellvol+=vol
 materialsok=materialsok and all(abs(a-b)<1e-9*max(1,abs(b)) for a,b in zip(material_values(material),material_values(mat)))
 if e.mesh.Faces.Count!=rec['faces'] or len(e.x_ori_list)!=rec['faces']:raise ValueError('Face count / material axes changed in native model.')
 if abs(h/rec['thickness_m']-1)>1e-8:raise ValueError('Native shell thickness differs from A/width.')
 for route in rec['routes']:
  owner=(rec['panel'],rec['family'],route['strand']);route_nodes=set()
  # MeshToShell compacts shared local vertices: use the actual face topology,
  # rather than assuming the input vertex list still has its original order.
  for fi in range(route['face_begin'],route['face_begin']+route['face_count']):
   f=e.mesh.Faces[fi];route_nodes.update(int(e.node_inds[k]) for k in [f.A,f.B,f.C])
  if len(route_nodes)!=(meta.get('width_divisions',2)+1)*(meta['segments']+1):raise ValueError('Spatial ribbon lost nodes during native assembly.')
  endnodes=set()
  for target in [route['start'],route['end']]:
   def distance(ni):
    p=nodes[ni].pos;return math.sqrt(sum((getattr(p,k)-v)**2 for k,v in zip(['X','Y','Z'],target)))
   ni=min(route_nodes,key=distance);err=distance(ni);endpoint_error=max(endpoint_error,err);endpoint_count+=1;endnodes.add(ni)
   if ni not in framenodes or err>2e-6:raise ValueError('Strand endpoint moved or is not bonded to its matching boundary frame.')
  across=rg.Vector3d.CrossProduct(rg.Vector3d(*route['normal']),rg.Vector3d(*route['direction']));across.Unitize()
  startpoint=rg.Point3d(*route['start']);direction=rg.Vector3d(*route['direction']);nw=meta['width_divisions']
  cloud=rg.PointCloud([startpoint+direction*(fraction*route['length_m'])+across*((column/float(nw)-.5)*rec['width_m']) for fraction in route['station_fractions'] for column in range(nw+1)])
  for ni in route_nodes:
   p=nodes[ni].pos;point=rg.Point3d(p.X,p.Y,p.Z);coordinate_error=max(coordinate_error,point.DistanceTo(cloud[cloud.ClosestPoint(point)].Location))
  cloud.Dispose()
  route['_endnodes']=endnodes
  for ni in route_nodes-endnodes:
   if ni in framenodes:raise ValueError('Unintended ribbon interior/frame bond.')
   if ni in owners and owners[ni]!=owner:raise ValueError('Unintended bond between separate spatial strands.')
   owners[ni]=owner
 route_cursor=0
 for fi,f in enumerate(e.mesh.Faces):
  nodeids=[e.node_inds[i] for i in [f.A,f.B,f.C]];join(nodeids[0],nodeids[1]);join(nodeids[0],nodeids[2]);pts=[nodes[i].pos for i in nodeids];centre=[sum(getattr(p,k) for p in pts)/3 for k in ['X','Y','Z']]
  while fi>=rec['routes'][route_cursor]['face_begin']+rec['routes'][route_cursor]['face_count']:route_cursor+=1
  route=rec['routes'][route_cursor]
  if fi<route['face_begin']:raise ValueError('Ribbon face ownership contains a gap.')
  direction=rg.Vector3d(*route['direction']);axis=vector(e.x_ori_list[fi]);axis.Unitize();axiserr=max(axiserr,abs(1-abs(axis*direction)))
  a,b,c=[rg.Point3d(p.X,p.Y,p.Z) for p in pts];normal=rg.Vector3d.CrossProduct(b-a,c-a);normal.Unitize();tangenterr=max(tangenterr,abs(axis*normal));yy=rg.Vector3d.CrossProduct(normal,axis);yy.Unitize()
  key=(int(e.ind),fi)
  if not all(key in d for d in maps):raise ValueError('Missing shell force face data.')
  force=[d[key] for d in maps];surfaces=stress_top_bottom(*(force+[h]))
  frac=sum((centre[j]-route['start'][j])*route['direction'][j] for j in range(3))/route['length_m']
  enddistance=min(abs(frac),abs(1-frac))*route['length_m']
  incident=bool(set(nodeids)&route['_endnodes'])
  for side,stress in zip(['top','bottom'],surfaces):
   s1,s2,tau=stress
   if any(math.isnan(v) or math.isinf(v) for v in stress):raise ValueError('Non-finite shell stress.')
   mr,tw=stress_failure_indices(s1,s2,tau,material.ft(0)/1000,abs(material.fc(0))/1000,material.ft(1)/1000,abs(material.fc(1))/1000,material.t12()*10,sf,material.f12())
   path=GH_Path(rec['panel'],rec['family'],route['strand'],fi-route['face_begin'],0 if side=='top' else 1)
   for tree,value in [(Sigma11,s1),(Sigma22,s2),(Tau12,tau),(Ratio,mr),(TsaiWu,tw)]:tree.Add(value,path)
   nxx,nyy,nxy=force[:3];fx=(axis*nxx+yy*nxy)*rec['width_m'];fy=(axis*nxy+yy*nyy)*rec['width_m'];fv=fx if fx.Length>=fy.Length else fy
   take(dict(kind='shell',element=int(e.ind),id=str(e.id),panel=rec['panel'],family=rec['family'],strand=route['strand'],face=fi,local_face=fi-route['face_begin'],side=side,attachment_incident=incident,nearest_attachment_distance_m=enddistance,strand_fraction=frac,sigma11_MPa=s1,sigma22_MPa=s2,tau12_MPa=tau,normal_MPa=max(abs(s1),abs(s2)),shear_MPa=abs(tau),ratio=mr,TsaiWu=tw,point=centre,force_vector_kN=[fv.X,fv.Y,fv.Z]));samples+=1
for e in beams:
 if not str(e.id).startswith('BOUNDARY'):raise ValueError('Duplicate original or reinforcement beam stiffness in ribbon model.')
 join(e.node_inds[0],e.node_inds[1]);volume+=float(e.Volume(nodes));area=float(e.crosec.A);diam=math.sqrt(4*area/math.pi);radius=diam/2;inertia=math.pi*diam**4/64;polar=2*inertia;modulus=inertia/radius;material=e.crosec.material
 materialsok=materialsok and abs(material.E(0)/mat.E(0)-1)<1e-10 and abs(material.gamma()/mat.gamma()-1)<1e-10 and abs(material.ft(0)/mat.ft(0)-1)<1e-10 and abs(material.fc(0)/mat.fc(0)-1)<1e-10
 forces=[d[int(e.ind)] for d in bm]
 for j in range(len(forces[0])):
  n,vy,vz,t,my,mz=[a[j] for a in forces];axial=n/area/1000;bending=math.sqrt(my*my+mz*mz)/modulus/1000;tau=(4.0/3*math.sqrt(vy*vy+vz*vz)/area+abs(t)*radius/polar)/1000;p=nodes[e.node_inds[j]].pos
  for normal in [axial+bending,axial-bending]:
   mr,tw=stress_failure_indices(normal,0,tau,material.ft(0)/1000,abs(material.fc(0))/1000,material.ft(1)/1000,abs(material.fc(1))/1000,material.t12()*10,sf,material.f12())
   axes=[vector(a) for a in e.localCoSys(nodes)];fv=axes[0]*n+axes[1]*vy+axes[2]*vz
   take(dict(kind='boundary beam',element=int(e.ind),id=str(e.id),point=[p.X,p.Y,p.Z],normal_MPa=abs(normal),shear_MPa=tau,ratio=mr,TsaiWu=tw,force_vector_kN=[fv.X,fv.Y,fv.Z]))
components=len(set(root(i) for i in range(len(nodes))));mass=volume*mat.gamma()*1000/9.80665;masserror=abs(mass-native_mass*10/9.80665);volerror=abs(shellvol/meta['volume_m3']-1)
u={}
for path in Trans.Paths:
 vs=list(Trans.Branch(path))
 if len(path.Indices)!=2 or path.Indices[0]!=0 or len(vs)!=1:raise ValueError('Unexpected displacement load-case/node path.')
 ni=int(path.Indices[-1])
 if ni in u:raise ValueError('Duplicate nodal displacement index.')
 u[ni]=vector(val(vs[0]))
if len(u)!=len(nodes):raise ValueError('Missing nodal displacement results.')
work=0;external=rg.Vector3d(0,0,0);externalmoment=rg.Vector3d(0,0,0)
for load in model.ploads:
 if load.local:raise ValueError('Global reference loads expected.')
 if vector(load.moment).Length>1e-12:raise ValueError('Point-moment work is outside this reference-load check.')
 f=vector(load.force);p=nodes[load.node_ind].pos;r=rg.Vector3d(p.X,p.Y,p.Z);external+=f;externalmoment+=rg.Vector3d.CrossProduct(r,f)+vector(load.moment);work+=.5*(f*u[load.node_ind])
rf=values(RF);rm=values(RM);rp=values(ReactionPos)
if len(rf)!=len(model.supports) or len(rm)!=len(rf):raise ValueError('Reaction/support count mismatch.')
if len(rp)!=len(rf):raise ValueError('Reaction position count mismatch.')
react=rg.Vector3d(0,0,0);reactmoment=rg.Vector3d(0,0,0)
for support,f,m,reactionpoint in zip(model.supports,rf,rm,rp):
 f=vector(f);m=vector(m);p=nodes[support.node_ind].pos;r=rg.Vector3d(p.X,p.Y,p.Z);react+=f;reactmoment+=m+rg.Vector3d.CrossProduct(r,f)
 if hasattr(reactionpoint,'Origin'):reactionpoint=reactionpoint.Origin
 if math.sqrt(sum((getattr(p,k)-getattr(reactionpoint,k))**2 for k in ['X','Y','Z']))>2e-6:raise ValueError('Reaction results do not follow matching support-node positions.')
forceerror=(external+react).Length;momenterror=(externalmoment+reactmoment).Length;energyerror=abs(work/energy-1) if energy else float('inf')
expectednodes=len(framenodes)+meta['strands']*((meta.get('width_divisions',2)+1)*(meta['segments']+1)-2)
def xyz(p):return [round(getattr(p,k),6) for k in ['X','Y','Z']]
fingerprint_data=dict(width=meta['width_m'],routes=[dict(name=r['name'],thickness=r['thickness_m'],routes=[dict(start=q['start'],end=q['end']) for q in r['routes']]) for r in meta['records']],boundary=[dict(start=xyz(nodes[e.node_inds[0]].pos),end=xyz(nodes[e.node_inds[1]].pos),area=float(e.crosec.A),section=str(e.crosec),section_type=str(e.crosec.GetType().FullName),material=material_values(e.crosec.material)) for e in beams],material=material_values(mat),safety_factor=sf,loads=[dict(position=xyz(nodes[p.node_ind].pos),force=[p.force.X,p.force.Y,p.force.Z]) for p in model.ploads],supports=[dict(position=xyz(nodes[s.node_ind].pos),condition=list(s.Condition),stiffness=list(s.Stiffness),local=bool(s.hasLocalCoosys),orientation=str(s.local_coosys) if s.hasLocalCoosys else 'global') for s in model.supports])
Fingerprint=hashlib.sha256(json.dumps(fingerprint_data,sort_keys=True,separators=(',',':')).encode('utf-8')).hexdigest()
ChecksPassed=coordinate_error<1e-10 and coupon and materialsok and axiserr<1e-9 and tangenterr<.001 and components==1 and forceerror<1e-5 and momenterror<1e-4 and energyerror<1e-5 and energy>0 and work>0 and volerror<1e-5 and masserror<.01 and len(nodes)==expectednodes
ReferenceStressPass=maxratio<=1 and maxtw<=1;ConstructionVerified=False;PeakNormal=maxnormal;PeakShear=maxshear;PeakRatio=maxratio;PeakTsaiWu=maxtw;DisplacementMM=disp_cm*10
hot.sort(key=lambda row:max(row['ratio'],row['TsaiWu']),reverse=True);HotPoints=[];HotVectors=[];HotLabels=[];seen=set()
for row in hot:
 key=tuple(int(round(v/.02)) for v in row['point'])
 if key in seen:continue
 seen.add(key);HotPoints.append(rg.Point3d(*row['point']));HotVectors.append(rg.Vector3d(*row['force_vector_kN']));HotLabels.append('%s | ratio %.3f | %.3f MPa'%(row['kind'],row['ratio'],row['normal_MPa']))
 if len(HotPoints)>=24:break
def summarize(kind):
 rows=[r for r in hot if r['kind']==kind]
 summary=dict(peak_normal_MPa=max(r['normal_MPa'] for r in rows),peak_shear_MPa=max(r['shear_MPa'] for r in rows),peak_stress_ratio=max(r['ratio'] for r in rows),peak_TsaiWu=max(r['TsaiWu'] for r in rows),governing_normal=max(rows,key=lambda r:r['normal_MPa']),governing_ratio=max(rows,key=lambda r:r['ratio']),governing_shear=max(rows,key=lambda r:r['shear_MPa']))
 if kind=='shell':summary.update(peak_sigma11_MPa=max(abs(r['sigma11_MPa']) for r in rows),governing_sigma11=max(rows,key=lambda r:abs(r['sigma11_MPa'])),peak_sigma22_MPa=max(abs(r['sigma22_MPa']) for r in rows),governing_sigma22=max(rows,key=lambda r:abs(r['sigma22_MPa'])))
 return summary
Result=json.dumps(dict(formulation='Direct UD flat ribbon shells + original boundary beams; idealized centre-point bonds',input_fingerprint=Fingerprint,segments=meta['segments'],width_divisions=meta.get('width_divisions',2),mesh_method=meta.get('mesh_method','legacy-single-precision-stagger'),width_mm=meta['width_m']*1000,strands=meta['strands'],shell_triangles=meta['triangles'],nodes=len(nodes),expected_unbonded_nodes=expectednodes,strand_endpoint_count=endpoint_count,strand_endpoint_max_error_m=endpoint_error,no_unintended_strand_bonds=True,boundary_beams=len(beams),connected_parts=components,native_coordinate_max_error_m=coordinate_error,exact_native_coordinates_verified=coordinate_error<1e-10,material_axes_error=axiserr,axis_tangency_error=tangenterr,assigned_materials_correct=materialsok,winding_volume_m3=shellvol,winding_volume_relative_error=volerror,physical_model_mass_kg=mass,native_mass_difference_kg=masserror,applied_force_kN=[external.X,external.Y,external.Z],force_equilibrium_residual_kN=forceerror,moment_equilibrium_residual_kNm=momenterror,elastic_energy_kNm=energy,external_work_kNm=work,energy_relative_error=energyerror,max_displacement_mm=DisplacementMM,peak_normal_MPa=PeakNormal,peak_shear_MPa=PeakShear,peak_stress_ratio=PeakRatio,peak_TsaiWu=PeakTsaiWu,reference_stress_pass=ReferenceStressPass,checks_passed=ChecksPassed,construction_verified=False,governing_normal=peak,ribbon=summarize('shell'),boundary=summarize('boundary beam'),critical_locations=hot[:24],attachment_diagnostics=dict(raw_peaks_retained=True,point_bond_model=True,secondary_probes_used_for_gate=False),f12_assumed=float(mat.f12()),safety_factor=sf,max_aspect=meta['max_aspect'],nominal_max_aspect=meta.get('max_nominal_aspect',meta['max_aspect']),scope='Existing sequential winding; four corner supports assumed; linear reference +X case; actual wind/gravity/allowable deflection/tow dimensions/bond/buckling not verified. Raw attachment peaks retained; stress convergence required.'),separators=(',',':'))
Report='17 | SPATIAL CFRP RESULTS - REFERENCE LOAD ONLY\nBasic geometry/equilibrium checks: %s. %s nodes; %s ribbon triangles; %s boundary beams; %s connected parts.\nMax normal %.3fMPa; max shear %.3fMPa; stress ratio %.5f; TsaiWu %.5f (SF%.2f, f12 assumed %.2f).\nMax displacement %.3fmm. Raw stress includes point-attachment peaks, both shell surfaces.\nForce residual %.3gkN; moment residual %.3gkNm; energy error %.3g.\nWinding volume error %.3g; mass %.3fkg (not added again to manufacturing metrics).\nLocal axes along actual 3D strands; E1/E2/G12 assigned from journal.\nReference material screening: %s. Modes/refinement are assessed separately in group 19.\nCONSTRUCTION SAFETY UNVERIFIED.'%('PASS' if ChecksPassed else 'FAIL',len(nodes),meta['triangles'],len(beams),components,PeakNormal,PeakShear,PeakRatio,PeakTsaiWu,sf,mat.f12(),DisplacementMM,forceerror,momenterror,energyerror,volerror,mass,'PASS' if ReferenceStressPass else 'FAIL')

# Release private postprocess scratch; all raw result trees and peaks above remain.
for _scratch in ['model','elements','shells','beams','nodes','maps','bm','u','hot','records','owners','framenodes','parent','meta','mat','material','route','rec','rows']:
 globals().pop(_scratch,None)

# Release private postprocess scratch; all raw result trees and peaks above remain.
for _scratch in ['model','elements','shells','beams','nodes','maps','bm','u','hot','records','owners','framenodes','parent','meta','mat','material','route','rec','rows']:
 globals().pop(_scratch,None)
# ---------- end raw_stresses_and_mechanical_checks ----------
panel_4 = Panel(raw_stresses_and_mechanical_checks.Report)  # disabled

# ---- group: 20 | OUTPUTS - length mass and projected visual openness
openness_scanlines_doubled_for_check = Panel("2400")  # disabled
openness_tolerance_percentage_points = Panel("0.5")  # disabled
pavilion_length_mass_openness = GhPythonScript(
    Meta=sequence_cfrp_owned_ribbons.Meta,
    Model=analyse_2.AnalysedModel,
    Rho=composite_density_kg_m3,
    NativeMass=owned_shell_assembly_explicit_indices.NativeMass,
    A=metric_boundary_a,
    B=metric_boundary_b,
    Resolution=openness_scanlines_doubled_for_check,
    OpenTol=openness_tolerance_percentage_points)  # -> LengthOriginal, LengthReinforcement, TotalRopeLength, LengthBoundary, TotalMass, TotalWeight, MassDifference, OpenTop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; inputs A: tree, B: tree; disabled
# ---------- pavilion_length_mass_openness: Python ----------
# -*- coding: ascii -*-
"""Live GH metrics for the active flat-ribbon FE geometry.

Inputs: Meta,Model,Rho,NativeMass,A,B,Resolution,OpenTol.
Outputs follow pavilion_metrics_code.py's thirteen-output order.
Builder must replace 'using System;\nusing System.Collections.Generic;\n\n// Intervals are analytic in X. Midpoint quadrature in Y is checked by doubling\n// the row count. All polygons supplied to Measure must be convex silhouettes.\npublic static class SpatialOpennessScanlineV1 {\n    struct Interval {\n        public double Lo, Hi;\n        public Interval(double lo, double hi) { Lo = lo; Hi = hi; }\n    }\n\n    sealed class Poly {\n        public double[] XY;\n        public double Lo = double.PositiveInfinity;\n        public double Hi = double.NegativeInfinity;\n        public Poly(double[] xy) {\n            if (xy == null || xy.Length < 6 || xy.Length % 2 != 0)\n                throw new ArgumentException("Convex silhouette needs three vertices.");\n            XY = xy;\n            for (int i = 0; i < xy.Length; ++i)\n                if (double.IsNaN(xy[i]) || double.IsInfinity(xy[i]))\n                    throw new ArgumentException("Silhouette coordinates must be finite.");\n            for (int i = 1; i < xy.Length; i += 2) {\n                Lo = Math.Min(Lo, xy[i]); Hi = Math.Max(Hi, xy[i]);\n            }\n        }\n    }\n\n    sealed class Stroke {\n        public double AX, AY, BX, BY, Radius, Lo, Hi;\n        public Poly Rect;\n        public Stroke(double[] line) {\n            if (line == null || line.Length != 5)\n                throw new ArgumentException("Boundary capsule needs x1,y1,x2,y2,diameter.");\n            for (int i = 0; i < line.Length; ++i)\n                if (double.IsNaN(line[i]) || double.IsInfinity(line[i]))\n                    throw new ArgumentException("Boundary coordinates must be finite.");\n            AX = line[0]; AY = line[1]; BX = line[2]; BY = line[3];\n            Radius = line[4] / 2.0;\n            if (Radius <= 0) throw new ArgumentException("Boundary diameter must be positive.");\n            Lo = Math.Min(AY, BY) - Radius; Hi = Math.Max(AY, BY) + Radius;\n            double dx = BX - AX, dy = BY - AY, len = Math.Sqrt(dx * dx + dy * dy);\n            double nx = len > 1e-14 ? -dy * Radius / len : Radius;\n            double ny = len > 1e-14 ? dx * Radius / len : 0;\n            Rect = new Poly(new double[] {\n                AX+nx,AY+ny,BX+nx,BY+ny,BX-nx,BY-ny,AX-nx,AY-ny\n            });\n        }\n        public Interval Slice(double y) {\n            double lo = double.PositiveInfinity, hi = double.NegativeInfinity;\n            Interval rectangle;\n            if (PolygonSlice(Rect, y, out rectangle)) { lo = rectangle.Lo; hi = rectangle.Hi; }\n            CircleSlice(AX, AY, Radius, y, ref lo, ref hi);\n            CircleSlice(BX, BY, Radius, y, ref lo, ref hi);\n            return new Interval(lo, hi);\n        }\n    }\n\n    static void CircleSlice(double x, double cy, double radius, double y,\n                            ref double lo, ref double hi) {\n        double dy = y - cy;\n        if (Math.Abs(dy) > radius) return;\n        double half = Math.Sqrt(Math.Max(0, radius * radius - dy * dy));\n        lo = Math.Min(lo, x - half); hi = Math.Max(hi, x + half);\n    }\n\n    static bool PolygonSlice(Poly polygon, double y, out Interval interval) {\n        double lo = double.PositiveInfinity, hi = double.NegativeInfinity;\n        for (int i = 0; i < polygon.XY.Length; i += 2) {\n            int j = (i + 2) % polygon.XY.Length;\n            double x1 = polygon.XY[i], y1 = polygon.XY[i + 1];\n            double x2 = polygon.XY[j], y2 = polygon.XY[j + 1];\n            if ((y1 <= y && y < y2) || (y2 <= y && y < y1)) {\n                double x = x1 + (y - y1) * (x2 - x1) / (y2 - y1);\n                lo = Math.Min(lo, x); hi = Math.Max(hi, x);\n            }\n        }\n        interval = new Interval(lo, hi); return hi >= lo;\n    }\n\n    static List<Interval> Union(List<Interval> intervals) {\n        intervals.Sort((a, b) => a.Lo.CompareTo(b.Lo));\n        var result = new List<Interval>();\n        foreach (Interval next in intervals) {\n            if (next.Hi < next.Lo) continue;\n            if (result.Count == 0 || next.Lo > result[result.Count - 1].Hi)\n                result.Add(next);\n            else {\n                Interval previous = result[result.Count - 1];\n                previous.Hi = Math.Max(previous.Hi, next.Hi);\n                result[result.Count - 1] = previous;\n            }\n        }\n        return result;\n    }\n\n    public static double[] Measure(double[][] boundaryCapsules,\n                                   double[][] occlusionPolygons,\n                                   double[][] domainPolygons, int rows) {\n        if (rows < 100) throw new ArgumentException("At least 100 scanlines are required.");\n        var domain = new List<Poly>();\n        double minY = double.PositiveInfinity, maxY = double.NegativeInfinity;\n        foreach (double[] xy in domainPolygons) {\n            var p = new Poly(xy); domain.Add(p);\n            minY = Math.Min(minY, p.Lo); maxY = Math.Max(maxY, p.Hi);\n        }\n        if (!(maxY > minY)) throw new ArgumentException("Empty or degenerate panel domain.");\n        var polygons = new List<Poly>();\n        foreach (double[] xy in occlusionPolygons) polygons.Add(new Poly(xy));\n        polygons.Sort((a, b) => a.Lo.CompareTo(b.Lo));\n        var strokes = new List<Stroke>();\n        foreach (double[] line in boundaryCapsules) strokes.Add(new Stroke(line));\n        strokes.Sort((a, b) => a.Lo.CompareTo(b.Lo));\n\n        var activePolys = new List<Poly>(); var activeStrokes = new List<Stroke>();\n        int nextPoly = 0, nextStroke = 0;\n        double step = (maxY - minY) / rows, full = 0, closed = 0;\n        for (int row = 0; row < rows; ++row) {\n            double y = minY + (row + 0.5) * step;\n            while (nextPoly < polygons.Count && polygons[nextPoly].Lo <= y)\n                activePolys.Add(polygons[nextPoly++]);\n            while (nextStroke < strokes.Count && strokes[nextStroke].Lo <= y)\n                activeStrokes.Add(strokes[nextStroke++]);\n            var domainIntervals = new List<Interval>();\n            foreach (Poly p in domain) {\n                Interval interval;\n                if (p.Lo <= y && p.Hi >= y && PolygonSlice(p, y, out interval))\n                    domainIntervals.Add(interval);\n            }\n            domainIntervals = Union(domainIntervals);\n            var ink = new List<Interval>();\n            for (int k = activePolys.Count - 1; k >= 0; --k) {\n                Poly p = activePolys[k];\n                if (p.Hi < y) { activePolys.RemoveAt(k); continue; }\n                Interval interval;\n                if (PolygonSlice(p, y, out interval)) ink.Add(interval);\n            }\n            for (int k = activeStrokes.Count - 1; k >= 0; --k) {\n                Stroke s = activeStrokes[k];\n                if (s.Hi < y) { activeStrokes.RemoveAt(k); continue; }\n                Interval interval = s.Slice(y);\n                if (interval.Hi >= interval.Lo) ink.Add(interval);\n            }\n            ink = Union(ink);\n            foreach (Interval interval in domainIntervals) full += (interval.Hi - interval.Lo) * step;\n            int a = 0, b = 0;\n            while (a < domainIntervals.Count && b < ink.Count) {\n                double left = Math.Max(domainIntervals[a].Lo, ink[b].Lo);\n                double right = Math.Min(domainIntervals[a].Hi, ink[b].Hi);\n                if (right > left) closed += (right - left) * step;\n                if (domainIntervals[a].Hi < ink[b].Hi) ++a; else ++b;\n            }\n        }\n        if (full <= 0) throw new InvalidOperationException("Panel silhouette has no area.");\n        if (closed > full * (1 + 1e-10))\n            throw new InvalidOperationException("Clipped occlusion exceeds the domain.");\n        closed = Math.Max(0, Math.Min(closed, full));\n        return new double[] { 100 * (1 - closed / full), full, closed, rows };\n    }\n}\n' with repr(C# source).
"""
import math,json,hashlib,clr,System,scriptcontext as sc
clr.AddReference('Microsoft.CSharp')
from System import Array,Double

def val(v):return v.Value if hasattr(v,'Value') else v
def finite(v,label):
 v=float(v)
 if math.isnan(v) or math.isinf(v):raise ValueError(label+' must be finite.')
 return v
def positive(v,label):
 v=finite(v,label)
 if v<=0:raise ValueError(label+' must be positive.')
 return v
def dot(a,b):return sum(x*y for x,y in zip(a,b))
def cross(a,b):return (a[1]*b[2]-a[2]*b[1],a[2]*b[0]-a[0]*b[2],a[0]*b[1]-a[1]*b[0])
def unit(v,label):
 v=tuple(finite(x,label) for x in v);norm=math.sqrt(dot(v,v))
 if norm<=1e-12:raise ValueError(label+' has zero length.')
 return tuple(x/norm for x in v)
def hull(points):
 points=sorted(set(points))
 def turn(a,b,c):return (b[0]-a[0])*(c[1]-a[1])-(b[1]-a[1])*(c[0]-a[0])
 lower=[];upper=[]
 for p in points:
  while len(lower)>=2 and turn(lower[-2],lower[-1],p)<=0:lower.pop()
  lower.append(p)
 for p in reversed(points):
  while len(upper)>=2 and turn(upper[-2],upper[-1],p)<=0:upper.pop()
  upper.append(p)
 return lower[:-1]+upper[:-1]

model=val(Model);meta=json.loads(str(val(Meta)))
rho=positive(val(Rho),'Composite density');res=int(val(Resolution));tol=positive(val(OpenTol),'Openness tolerance');native_mass=positive(val(NativeMass),'Native mass')
if res<600:raise ValueError('At least 600 scanlines are required for finite strip openness.')
families={'WINDING':[0,0.0,0.0],'REINFORCEMENT':[0,0.0,0.0],'BOUNDARY':[0,0.0,0.0]}
prisms=[];boundaries=[];winding_volume=0.0;boundary_volume=0.0;widths=[];heights=[]
for record in meta['records']:
 family=int(record['family'])
 if family not in [0,1]:raise ValueError('Unknown spatial winding family.')
 name='WINDING' if family==0 else 'REINFORCEMENT'
 width=positive(record['width_m'],'Ribbon width');height=positive(record['thickness_m'],'Ribbon thickness');widths.append(width);heights.append(height)
 for route in record['routes']:
  a=tuple(finite(x,'Route start') for x in route['start']);b=tuple(finite(x,'Route end') for x in route['end'])
  length=positive(route['length_m'],'Route length');actual_length=math.sqrt(sum((x-y)**2 for x,y in zip(a,b)))
  if abs(actual_length/length-1)>1e-8:raise ValueError('Route geometry and manufacturing length differ.')
  direction=unit(route['direction'],'Ribbon direction');normal=unit(route['normal'],'Ribbon normal')
  if abs(dot(direction,normal))>1e-6:raise ValueError('Ribbon normal is not perpendicular to its strand.')
  if dot(direction,unit(tuple(y-x for x,y in zip(a,b)),'Endpoint direction'))<1-1e-8:raise ValueError('Ribbon direction differs from its endpoints.')
  across=unit(cross(normal,direction),'Ribbon across direction')
  volume=length*width*height
  if abs(volume/positive(route['volume_m3'],'Route volume')-1)>1e-8:raise ValueError('Width/thickness changed the retained winding volume.')
  winding_volume+=volume
  f=families[name];f[0]+=1;f[1]+=length;f[2]+=volume*rho
  # Project the convex silhouette of the actual assumed flat tow prism.
  # This creates numeric corner tuples only; no Rhino/Grasshopper solids.
  corners=[]
  for centre in [a,b]:
   for sw in [-.5,.5]:
    for sh in [-.5,.5]:
     corners.append(tuple(centre[i]+sw*width*across[i]+sh*height*normal[i] for i in range(3)))
  prisms.append(corners)
if not prisms:raise ValueError('Spatial winding metadata is empty.')
if abs(winding_volume/positive(meta['volume_m3'],'Total winding volume')-1)>1e-8:raise ValueError('Manufacturing winding volume does not match metadata.')
if len(prisms)!=int(meta['strands']):raise ValueError('Manufacturing strand count changed.')
beam_indices=set();shell_count=0
for element in model.Elements():
 kind=element.GetType().Name
 if kind=='ModelShell':shell_count+=1;continue
 if kind!='ModelBeam' or not str(element.id).startswith('BOUNDARY'):raise ValueError('Active ribbon model contains duplicate strand beams or an unexpected element.')
 index=int(element.ind)
 if index in beam_indices:raise ValueError('Boundary element counted twice.')
 beam_indices.add(index)
 a=model.nodes[element.node_inds[0]].pos;b=model.nodes[element.node_inds[1]].pos
 start=(float(a.X),float(a.Y),float(a.Z));end=(float(b.X),float(b.Y),float(b.Z))
 length=positive(math.sqrt(sum((x-y)**2 for x,y in zip(start,end))),'Boundary length');area=positive(element.crosec.A,'Boundary area');diameter=math.sqrt(4*area/math.pi)
 volume=length*area;boundary_volume+=volume
 f=families['BOUNDARY'];f[0]+=1;f[1]+=length;f[2]+=volume*rho
 boundaries.append(start+end+(diameter,))
if shell_count!=len(meta['records']):raise ValueError('Active shell patches and winding metadata differ.')
LengthOriginal=families['WINDING'][1];LengthReinforcement=families['REINFORCEMENT'][1];TotalRopeLength=LengthOriginal+LengthReinforcement;LengthBoundary=families['BOUNDARY'][1]
TotalMass=(winding_volume+boundary_volume)*rho;TotalWeight=TotalMass*9.80665/1000.0
# Karamba assembly's mass convention uses g=10. Correct only the comparison.
native_mass_corrected=native_mass*10.0/9.80665;MassDifference=abs(TotalMass-native_mass_corrected)
domain3d=[]
if [str(p) for p in A.Paths]!=[str(p) for p in B.Paths]:raise ValueError('A/B panel paths differ.')
for path in A.Paths:
 points=[]
 for tree in [A,B]:
  if len(tree.Branch(path))!=1:raise ValueError('Each panel needs exactly one A and one B boundary.')
  curve=val(tree.Branch(path)[0]);ok,poly=curve.TryGetPolyline()
  if not ok:raise ValueError('Panel boundaries must remain mesh polylines.')
  points.extend((float(p.X),float(p.Y),float(p.Z)) for p in poly)
 domain3d.append(points)
if not domain3d:raise ValueError('Paired panel silhouettes are empty.')
source='using System;\nusing System.Collections.Generic;\n\n// Intervals are analytic in X. Midpoint quadrature in Y is checked by doubling\n// the row count. All polygons supplied to Measure must be convex silhouettes.\npublic static class SpatialOpennessScanlineV1 {\n    struct Interval {\n        public double Lo, Hi;\n        public Interval(double lo, double hi) { Lo = lo; Hi = hi; }\n    }\n\n    sealed class Poly {\n        public double[] XY;\n        public double Lo = double.PositiveInfinity;\n        public double Hi = double.NegativeInfinity;\n        public Poly(double[] xy) {\n            if (xy == null || xy.Length < 6 || xy.Length % 2 != 0)\n                throw new ArgumentException("Convex silhouette needs three vertices.");\n            XY = xy;\n            for (int i = 0; i < xy.Length; ++i)\n                if (double.IsNaN(xy[i]) || double.IsInfinity(xy[i]))\n                    throw new ArgumentException("Silhouette coordinates must be finite.");\n            for (int i = 1; i < xy.Length; i += 2) {\n                Lo = Math.Min(Lo, xy[i]); Hi = Math.Max(Hi, xy[i]);\n            }\n        }\n    }\n\n    sealed class Stroke {\n        public double AX, AY, BX, BY, Radius, Lo, Hi;\n        public Poly Rect;\n        public Stroke(double[] line) {\n            if (line == null || line.Length != 5)\n                throw new ArgumentException("Boundary capsule needs x1,y1,x2,y2,diameter.");\n            for (int i = 0; i < line.Length; ++i)\n                if (double.IsNaN(line[i]) || double.IsInfinity(line[i]))\n                    throw new ArgumentException("Boundary coordinates must be finite.");\n            AX = line[0]; AY = line[1]; BX = line[2]; BY = line[3];\n            Radius = line[4] / 2.0;\n            if (Radius <= 0) throw new ArgumentException("Boundary diameter must be positive.");\n            Lo = Math.Min(AY, BY) - Radius; Hi = Math.Max(AY, BY) + Radius;\n            double dx = BX - AX, dy = BY - AY, len = Math.Sqrt(dx * dx + dy * dy);\n            double nx = len > 1e-14 ? -dy * Radius / len : Radius;\n            double ny = len > 1e-14 ? dx * Radius / len : 0;\n            Rect = new Poly(new double[] {\n                AX+nx,AY+ny,BX+nx,BY+ny,BX-nx,BY-ny,AX-nx,AY-ny\n            });\n        }\n        public Interval Slice(double y) {\n            double lo = double.PositiveInfinity, hi = double.NegativeInfinity;\n            Interval rectangle;\n            if (PolygonSlice(Rect, y, out rectangle)) { lo = rectangle.Lo; hi = rectangle.Hi; }\n            CircleSlice(AX, AY, Radius, y, ref lo, ref hi);\n            CircleSlice(BX, BY, Radius, y, ref lo, ref hi);\n            return new Interval(lo, hi);\n        }\n    }\n\n    static void CircleSlice(double x, double cy, double radius, double y,\n                            ref double lo, ref double hi) {\n        double dy = y - cy;\n        if (Math.Abs(dy) > radius) return;\n        double half = Math.Sqrt(Math.Max(0, radius * radius - dy * dy));\n        lo = Math.Min(lo, x - half); hi = Math.Max(hi, x + half);\n    }\n\n    static bool PolygonSlice(Poly polygon, double y, out Interval interval) {\n        double lo = double.PositiveInfinity, hi = double.NegativeInfinity;\n        for (int i = 0; i < polygon.XY.Length; i += 2) {\n            int j = (i + 2) % polygon.XY.Length;\n            double x1 = polygon.XY[i], y1 = polygon.XY[i + 1];\n            double x2 = polygon.XY[j], y2 = polygon.XY[j + 1];\n            if ((y1 <= y && y < y2) || (y2 <= y && y < y1)) {\n                double x = x1 + (y - y1) * (x2 - x1) / (y2 - y1);\n                lo = Math.Min(lo, x); hi = Math.Max(hi, x);\n            }\n        }\n        interval = new Interval(lo, hi); return hi >= lo;\n    }\n\n    static List<Interval> Union(List<Interval> intervals) {\n        intervals.Sort((a, b) => a.Lo.CompareTo(b.Lo));\n        var result = new List<Interval>();\n        foreach (Interval next in intervals) {\n            if (next.Hi < next.Lo) continue;\n            if (result.Count == 0 || next.Lo > result[result.Count - 1].Hi)\n                result.Add(next);\n            else {\n                Interval previous = result[result.Count - 1];\n                previous.Hi = Math.Max(previous.Hi, next.Hi);\n                result[result.Count - 1] = previous;\n            }\n        }\n        return result;\n    }\n\n    public static double[] Measure(double[][] boundaryCapsules,\n                                   double[][] occlusionPolygons,\n                                   double[][] domainPolygons, int rows) {\n        if (rows < 100) throw new ArgumentException("At least 100 scanlines are required.");\n        var domain = new List<Poly>();\n        double minY = double.PositiveInfinity, maxY = double.NegativeInfinity;\n        foreach (double[] xy in domainPolygons) {\n            var p = new Poly(xy); domain.Add(p);\n            minY = Math.Min(minY, p.Lo); maxY = Math.Max(maxY, p.Hi);\n        }\n        if (!(maxY > minY)) throw new ArgumentException("Empty or degenerate panel domain.");\n        var polygons = new List<Poly>();\n        foreach (double[] xy in occlusionPolygons) polygons.Add(new Poly(xy));\n        polygons.Sort((a, b) => a.Lo.CompareTo(b.Lo));\n        var strokes = new List<Stroke>();\n        foreach (double[] line in boundaryCapsules) strokes.Add(new Stroke(line));\n        strokes.Sort((a, b) => a.Lo.CompareTo(b.Lo));\n\n        var activePolys = new List<Poly>(); var activeStrokes = new List<Stroke>();\n        int nextPoly = 0, nextStroke = 0;\n        double step = (maxY - minY) / rows, full = 0, closed = 0;\n        for (int row = 0; row < rows; ++row) {\n            double y = minY + (row + 0.5) * step;\n            while (nextPoly < polygons.Count && polygons[nextPoly].Lo <= y)\n                activePolys.Add(polygons[nextPoly++]);\n            while (nextStroke < strokes.Count && strokes[nextStroke].Lo <= y)\n                activeStrokes.Add(strokes[nextStroke++]);\n            var domainIntervals = new List<Interval>();\n            foreach (Poly p in domain) {\n                Interval interval;\n                if (p.Lo <= y && p.Hi >= y && PolygonSlice(p, y, out interval))\n                    domainIntervals.Add(interval);\n            }\n            domainIntervals = Union(domainIntervals);\n            var ink = new List<Interval>();\n            for (int k = activePolys.Count - 1; k >= 0; --k) {\n                Poly p = activePolys[k];\n                if (p.Hi < y) { activePolys.RemoveAt(k); continue; }\n                Interval interval;\n                if (PolygonSlice(p, y, out interval)) ink.Add(interval);\n            }\n            for (int k = activeStrokes.Count - 1; k >= 0; --k) {\n                Stroke s = activeStrokes[k];\n                if (s.Hi < y) { activeStrokes.RemoveAt(k); continue; }\n                Interval interval = s.Slice(y);\n                if (interval.Hi >= interval.Lo) ink.Add(interval);\n            }\n            ink = Union(ink);\n            foreach (Interval interval in domainIntervals) full += (interval.Hi - interval.Lo) * step;\n            int a = 0, b = 0;\n            while (a < domainIntervals.Count && b < ink.Count) {\n                double left = Math.Max(domainIntervals[a].Lo, ink[b].Lo);\n                double right = Math.Min(domainIntervals[a].Hi, ink[b].Hi);\n                if (right > left) closed += (right - left) * step;\n                if (domainIntervals[a].Hi < ink[b].Hi) ++a; else ++b;\n            }\n        }\n        if (full <= 0) throw new InvalidOperationException("Panel silhouette has no area.");\n        if (closed > full * (1 + 1e-10))\n            throw new InvalidOperationException("Clipped occlusion exceeds the domain.");\n        closed = Math.Max(0, Math.Min(closed, full));\n        return new double[] { 100 * (1 - closed / full), full, closed, rows };\n    }\n}\n'
source_hash=hashlib.sha256(source.encode('ascii')).hexdigest()
fingerprint=hashlib.sha256(repr((source_hash,prisms,boundaries,domain3d,rho,native_mass,res,tol)).encode('ascii')).hexdigest()
cachekey='SpatialRibbonOpennessV1_'+fingerprint
if cachekey in sc.sticky:openness=sc.sticky[cachekey]
else:
 typekey='SpatialRibbonOpennessType_'+source_hash
 if typekey not in sc.sticky:
  from Microsoft.CSharp import CSharpCodeProvider
  from System.CodeDom.Compiler import CompilerParameters
  compiler=CompilerParameters();compiler.GenerateInMemory=True;compiler.ReferencedAssemblies.Add('System.dll')
  compiled=CSharpCodeProvider().CompileAssemblyFromSource(compiler,Array[str]([source]))
  if compiled.Errors.HasErrors:raise ValueError(';'.join(str(error) for error in compiled.Errors))
  sc.sticky[typekey]=compiled.CompiledAssembly.GetType('SpatialOpennessScanlineV1')
 method=sc.sticky[typekey].GetMethod('Measure');openness=[]
 for label,ix,iy in [('Top',0,1),('Front',0,2),('Right',1,2)]:
  ll=Array[Array[Double]]([Array[Double]([line[ix],line[iy],line[3+ix],line[3+iy],line[6]]) for line in boundaries])
  occlusion=[];domains=[]
  for corners in prisms:
   polygon=hull([(p[ix],p[iy]) for p in corners])
   if len(polygon)<3:raise ValueError('A finite ribbon prism has a degenerate projected silhouette.')
   occlusion.append(Array[Double]([coordinate for p in polygon for coordinate in p]))
  for points in domain3d:
   polygon=hull([(p[ix],p[iy]) for p in points])
   if len(polygon)>=3:domains.append(Array[Double]([coordinate for p in polygon for coordinate in p]))
  oo=Array[Array[Double]](occlusion);pp=Array[Array[Double]](domains)
  low=list(method.Invoke(None,Array[System.Object]([ll,oo,pp,System.Int32(res)])))
  high=list(method.Invoke(None,Array[System.Object]([ll,oo,pp,System.Int32(res*2)])))
  delta=abs(high[0]-low[0]);openness.append(dict(view=label,open_percent=high[0],domain_m2=high[1],occluded_m2=high[2],resolution=res*2,convergence_delta_percentage_points=delta,converged=delta<=tol))
 sc.sticky[cachekey]=openness
OpenTop=openness[0]['open_percent'];OpenFront=openness[1]['open_percent'];OpenRight=openness[2]['open_percent'];OpennessConverged=all(p['converged'] for p in openness)
notes=['Manufacturing strand lengths and volumes come from original/reinforcement route metadata; all coordinates are undeformed metres.',
 'Active FE strand opacity uses the assumed flat rectangular tow width and thickness, including its actual 3D orientation; it is not the earlier equivalent 5mm round-capsule estimate.',
 'Boundary beams are counted once from the assembled model, with finite circular-section capsule silhouettes.',
 'Mass is rho times exact length*width*thickness plus unique boundary length*area; shell mesh floating-point area is not used.',
 'Mass includes modeled cured CFRP composite only; unknown joints, fittings, foundations and equipment are excluded.',
 'Openness is orthographic projected open area in Top/Front/Right, clipped to the union of paired A/B panel convex silhouettes.',
 'All overlaps are unioned once using analytic horizontal intervals. Midpoint scanlines are doubled to check numerical convergence.',
 'Physical gravity is 9.80665m/s2; native assembly mass is corrected from its g=10 convention only for comparison.',
 'Numeric prism corners do not create Pipe or additional solid geometry or additional material volume.',
 'Tow width/thickness and joint geometry are reference assumptions. Construction safety remains unverified.']
payload=dict(method='Active spatial flat ribbon prism silhouettes + boundary capsules',input_fingerprint=fingerprint,original_winding_length_m=LengthOriginal,reinforcement_length_m=LengthReinforcement,total_rope_length_m=TotalRopeLength,boundary_length_m=LengthBoundary,total_model_length_m=TotalRopeLength+LengthBoundary,total_model_mass_kg=TotalMass,winding_volume_m3=winding_volume,boundary_volume_m3=boundary_volume,native_mass_kg=native_mass,native_mass_corrected_kg=native_mass_corrected,karamba_mass_gravity_m_s2=10.0,mass_difference_kg=MassDifference,mass_consistent=MassDifference<=.01,total_weight_kN=TotalWeight,density_kg_m3=rho,ribbon_widths_mm=sorted(set(w*1000 for w in widths)),ribbon_thicknesses_mm=sorted(set(h*1000 for h in heights)),families=families,openness=openness,notes=notes,construction_verified=False)
DataJSON=json.dumps(payload,indent=2)
Report='LIVE SPATIAL RIBBON METRICS\nTotal rope %.3f m = original %.3f + reinforcement %.3f.\nUnique boundaries %.3f m.\nExact modeled CFRP volume %.6fm3; mass %.3fkg; weight %.4fkN.\nNative mass corrected %.3fkg; difference %.6fkg.\nVisual openness Top %.3f%%; Front %.3f%%; Right %.3f%%.\nFinite flat-tow width %.3f-%.3fmm; thickness %.6f-%.6fmm, following actual 3D strand orientation.\nPaired-panel silhouette union; boundary capsules; %d scanlines; convergence within %.3fpp = %s.\nReplaces the earlier equivalent 5mm round-strand opacity estimate. No extra geometry or volume.\nTow dimensions are assumed; mass excludes unknown joints/foundations. Construction safety UNVERIFIED.'%(TotalRopeLength,LengthOriginal,LengthReinforcement,LengthBoundary,winding_volume+boundary_volume,TotalMass,TotalWeight,native_mass_corrected,MassDifference,OpenTop,OpenFront,OpenRight,min(widths)*1000,max(widths)*1000,min(heights)*1000,max(heights)*1000,res*2,tol,OpennessConverged)
# ---------- end pavilion_length_mass_openness ----------
panel_5 = Panel(pavilion_length_mass_openness.Report)  # disabled

# ---- group: 17c | CRITICAL FORCE VECTORS - display only
# 17c | CRITICAL FORCE PREVIEW
# 24 spatially separated locations ranked by material demand.
# Actual shell local N-resultants or beam N/V-resultants in kN.
# Display scale changes arrows only; geometry, stress and mass remain unchanged.
# No automatic reinforcement or additional winding is created.
force_arrow_display_scale_m_kn = Panel("1")  # disabled
critical_locations_24_separated = Point(raw_stresses_and_mechanical_checks.HotPoints)  # disabled
force_vectors_preview_scale_only = GhPythonScript(Vectors=raw_stresses_and_mechanical_checks.HotVectors, Scale=force_arrow_display_scale_m_kn)  # -> ScaledVectors; inputs Vectors: list; disabled
# ---------- force_vectors_preview_scale_only: Python ----------
import Rhino.Geometry as rg
ScaledVectors=[rg.Vector3d(v.Value if hasattr(v,'Value') else v)*float(Scale.Value if hasattr(Scale,'Value') else Scale) for v in Vectors]
# ---------- end force_vectors_preview_scale_only ----------
critical_fe_force_vectors_kn = VectorDisplay(Anchor=raw_stresses_and_mechanical_checks.HotPoints, Vector=force_vectors_preview_scale_only)  # disabled

# ---- group: 18 | LIVE OUTPUT DASHBOARD
# 18 | LIVE RESULTS - REFERENCE LATERAL +X 1kN
# Normal/shear envelopes include boundary beams and raw ribbon peaks.
# Modeled CFRP mass includes winding + unique frames; unknown joints/foundations excluded.
# Openness is projected open area, Top/Front/Right.
# See live mechanical/material gates in group19. Stress mesh convergence and construction safety UNVERIFIED.
total_rope_length_m = Panel(pavilion_length_mass_openness.TotalRopeLength)  # disabled
total_pavilion_mass_kg = Panel(pavilion_length_mass_openness.TotalMass)  # disabled
openness_top = Panel(pavilion_length_mass_openness.OpenTop)  # disabled
max_tsai_wu_sf2 = Panel(raw_stresses_and_mechanical_checks.PeakTsaiWu)  # disabled
maximum_shear_mpa = Panel(raw_stresses_and_mechanical_checks.PeakShear)  # disabled
openness_right = Panel(pavilion_length_mass_openness.OpenRight)  # disabled
openness_front = Panel(pavilion_length_mass_openness.OpenFront)  # disabled
maximum_normal_stress_mpa = Panel(raw_stresses_and_mechanical_checks.PeakNormal)  # disabled
max_displacement_mm = Panel(raw_stresses_and_mechanical_checks.DisplacementMM)  # disabled

# ---- group: 19 | VALIDITY GATE - convergence untested
# 19 | NUMERICAL VALIDITY
# This new sequence geometry has not undergone mesh convergence.
# Basic FE checks and material screening are separate from construction safety.
# No eigenmode/buckling/actual wind verification is claimed.
# Keep raw point attachment stress peaks. Do not filter them to obtain PASS.
# Geometry updates require a new FE solve and numerical review.
basic_fe_validation = Panel(raw_stresses_and_mechanical_checks.ChecksPassed)  # disabled
reference_material_screening = Panel(raw_stresses_and_mechanical_checks.ReferenceStressPass)  # disabled
construction_verified = Panel(raw_stresses_and_mechanical_checks.ConstructionVerified)  # disabled
openness_converged = Panel(pavilion_length_mass_openness.OpennessConverged)  # disabled
